# Grasshopper definition FeedbackSystem_Branch.gh (Grasshopper 1.0.7)
# plug-ins: Heteroptera, Human, Squid

number_slider = Slider(51, range=0..100)  # disabled
number_slider_2 = Slider(18, range=0..100)  # disabled
txt = Text(["A", "B", "C", "D", "E", "F", "G", "H", "I", "J", "K", "L", "M", "N", "O", "P", "Q", "R", "S", "T", "U", "V", "W", "X", "Y", "Z"])  # disabled
font = Font(Family="Arial", Size=number_slider, Bold=False, Italic=False, Underline=False)  # disabled
item = ListItem(List=txt, Index=number_slider_2, Wrap=True)  # disabled
number_slider_3 = Slider(51, range=0..100)  # disabled
number_slider_4 = Slider(18, range=0..100)  # disabled
textc = TextCurves(Plane=PlaneXY(0, 0, 0), Text=item, Font=font)  # disabled
number_slider_5 = Slider(51, range=0..100)  # disabled
number_slider_6 = Slider(18, range=0..100)  # disabled
txt_2 = Text(["A", "B", "C", "D", "E", "F", "G", "H", "I", "J", "K", "L", "M", "N", "O", "P", "Q", "R", "S", "T", "U", "V", "W", "X", "Y", "Z"])  # disabled
font_2 = Font(Family="Arial", Size=number_slider_3, Bold=False, Italic=False, Underline=False)  # disabled
center = Center(Geometric=textc, forall=True)  # -> Center, Dimension; disabled
item_2 = ListItem(List=txt_2, Index=number_slider_4, Wrap=True)  # disabled
txt_3 = Text(["A", "B", "C", "D", "E", "F", "G", "H", "I", "J", "K", "L", "M", "N", "O", "P", "Q", "R", "S", "T", "U", "V", "W", "X", "Y", "Z"])  # disabled
font_3 = Font(Family="Arial", Size=number_slider_5, Bold=False, Italic=False, Underline=False)  # disabled
textc_2 = TextCurves(Plane=PlaneXY(0, 0, 0), Text=item_2, Font=font_2)  # disabled
item_3 = ListItem(List=txt_3, Index=number_slider_6, Wrap=True)  # disabled
textc_3 = TextCurves(Plane=PlaneXY(0, 0, 0), Text=item_3, Font=font_3)  # disabled
center_2 = Center(Geometric=textc_2, forall=True)  # -> Center, Dimension; disabled
number_slider_7 = Slider(100, range=0..100)
number_slider_8 = Slider(240, range=0..1000)
center_3 = Center(Geometric=textc_3, forall=True)  # -> Center, Dimension; disabled
number_slider_9 = Slider(100, range=0..100)  # disabled
number_slider_10 = Slider(0, range=0..10)  # disabled
number_slider_11 = Slider(0, range=-10..10)  # disabled
number_slider_12 = Slider(0, range=-10..10)  # disabled
number_slider_13 = Slider(0, range=-0.1..0.1)  # disabled
rectangle = Rectangle(Plane=PlaneXY(0, 0, 0), XSize=number_slider_7, YSize=number_slider_7, Radius=0)  # -> Rectangle, Length
number_slider_14 = Slider(100, range=0..200)  # disabled
number_slider_15 = Slider(240, range=0..1000)  # disabled
number_slider_16 = Slider(0, range=0..10)  # disabled
mplane = MeshPlane(Boundary=rectangle.Rectangle, WidthCount=number_slider_8, HeightCount=number_slider_8)  # -> Mesh, Area
number_slider_17 = Slider(500, range=0..1000)  # disabled
number_slider_18 = Slider(100, range=0..200)  # disabled
rectangle_2 = Rectangle(Plane=PlaneXY(0, 0, 0), XSize=number_slider_9, YSize=number_slider_9, Radius=0)  # -> Rectangle, Length; disabled
number_slider_19 = Slider(0, range=0..10)  # disabled
number_slider_20 = Slider(0, range=-10..10)  # disabled
number_slider_21 = Slider(0, range=-10..10)  # disabled
number_slider_22 = Slider(8, range=0..24)  # disabled
number_slider_23 = Slider(1.02, range=0.9..1.1)  # disabled
pt = ConstructPoint(XCoordinate=0, YCoordinate=0, ZCoordinate=0)  # disabled
pt_2 = ConstructPoint(XCoordinate=number_slider_11, YCoordinate=number_slider_12, ZCoordinate=number_slider_10)  # disabled
number_slider_24 = Slider(0.97, range=0.9..1.1)  # disabled
number_slider_25 = Slider(1, range=0.9..1.1)  # disabled
number_slider_26 = Slider(1, range=0.9..1.1)  # disabled
number_slider_27 = Slider(100, range=0..200)
path = FilePath("C:\Users\RT-01\Desktop\Test.jpg")  # disabled
number_slider_28 = Slider(240, range=0..1000)  # disabled
number_slider_29 = Slider(0, range=-0.1..0.1)  # disabled
number_slider_30 = Slider(0, range=0..1)  # disabled
rectangle_3 = Rectangle(Plane=PlaneXY(0, 0, 0), XSize=number_slider_14, YSize=number_slider_14, Radius=0)  # -> Rectangle, Length; disabled
center_4 = Center(Geometric=rectangle_3.Rectangle)  # -> Center, Dimension; disabled
orient = Orient(Geometry=textc, Source=center.Center, Target=center_4.Center)  # -> Geometry, Transform; disabled
cpoly = ControlPolygon(Curve=orient.Geometry)  # -> Polygon, Points; disabled
pline = PolyLine(Vertices=cpoly.Points, Closed=False)  # disabled
explode = Explode(Curve=pline, Recursive=True)  # -> Segments, Vertices; disabled
data = Data(flatten(explode.Segments))  # disabled
line = Line(data)  # disabled
data_2 = Data(center_4.Center)  # disabled
center_5 = Center(Geometric=line, forall=True)  # -> Center, Dimension; disabled
rotate = Rotate(Geometry=line, Angle=number_slider_16, Plane=center_5.Center)  # -> Geometry, Transform; disabled
curvepoint = PointOnCurve(rotate.Geometry, parameter=1)  # disabled
number_slider_31 = Slider(0.99606201, range=0..1)  # disabled
button = Button()  # disabled
pt_3 = ConstructPoint(XCoordinate=0, YCoordinate=0, ZCoordinate=0)
trigger = Trigger(Interval=1, TimerInterval=5, Target=c_script)  # disabled
mplane_2 = MeshPlane(Boundary=rectangle_2.Rectangle, WidthCount=number_slider_15, HeightCount=number_slider_15)  # -> Mesh, Area; disabled
number_slider_32 = Slider(0, range=0..10)  # disabled
number_slider_33 = Slider(240, range=0..1000)
number_slider_34 = Slider(1, range=0..1)  # disabled
data_3 = Data(pt)  # disabled
move = Move(Motion=pt_2)  # -> Geometry, Transform; disabled
rectangle_4 = Rectangle(Plane=PlaneXY(0, 0, 0), XSize=number_slider_18, YSize=number_slider_18, Radius=0)  # -> Rectangle, Length; disabled
number_slider_35 = Slider(1, range=0..1)  # disabled
mplane_3 = MeshPlane(Boundary=rectangle_3.Rectangle, WidthCount=number_slider_17, HeightCount=number_slider_17)  # -> Mesh, Area; disabled
number_slider_36 = Slider(0, range=0..10)  # disabled
move_2 = Move(Geometry=line, Motion=Vector(0, 0, 10))  # -> Geometry, Transform; disabled
c_script = CSharpScript(
    file=path,
    baseMesh=mplane.Mesh,
    bound=rectangle.Rectangle,
    strokeSize=Slider(6, range=0..100),
    threshold=Slider(0.5, range=0..1),
    edgeSegmentLength=number_slider_22,
    reset=button)  # -> out, A; inputs file: String, baseMesh: Mesh, bound: Rectangle3d, strokeSize: Double, threshold: Double, edgeSegmentLength: Double, reset: Boolean; disabled
# ---------- c_script: C# usings ----------
using System.Drawing;
using Grasshopper.Kernel.Geometry;
# ---------- c_script: C# ----------
    if (counter == 0){
      sourceImg = new Bitmap(file);
      rw = sourceImg.Width;
      rh = sourceImg.Height;

      iterImg = sourceImg.Clone(new Rectangle(0, 0, rw, rh), sourceImg.PixelFormat);
      canvas = Graphics.FromImage(iterImg);
      lines = new List<Line>();
      process = new Grasshopper.DataTree<Line>();
    }
    counter++;

    if(reset){
      counter = 0;
    }

    //Drawing setup - pen and shape
    pen = new Pen(Color.White, Convert.ToSingle(rw * strokeSize / bound.Width));
    pen.StartCap = System.Drawing.Drawing2D.LineCap.Round;
    pen.EndCap = System.Drawing.Drawing2D.LineCap.Round;

    //Skeletonize and draw on iterImg with skeleton trails
    lines.Clear();
    Extract(threshold, iterImg, baseMesh, bound, edgeSegmentLength, pen.Width, ref lines);
    canvas.Clear(Color.Black);

    foreach(Line l in lines){
      canvas.DrawLine(pen, Convert.ToInt32(rw * (l.From.X - bound.X.Min) / bound.Width), Convert.ToInt32(rh * (l.From.Y - bound.Y.Min) / bound.Height), Convert.ToInt32(rw * (l.To.X - bound.X.Min) / bound.Width), Convert.ToInt32(rh * (l.To.Y - bound.Y.Min) / bound.Height));
    }
    Print(counter.ToString());
    A = lines;
# ---------- c_script: C# additional code ----------
  Rhino.Geometry.Plane cutter = new Rhino.Geometry.Plane(new Point3d(0, 0, 0.5), new Vector3d(0, 0, 1));
  Bitmap sourceImg;
  Bitmap iterImg;
  Graphics canvas;
  int rw;
  int rh;
  List<Line> lines;
  Grasshopper.DataTree<Line> process;
  Pen pen;


  int counter = 0;
  public void Extract(double threshold0, Bitmap sourceImg0, Mesh baseMesh0, Rectangle3d r0, double edgeSegmentLength0, double maxSkeletonLength0, ref List<Line> result){
    double threshold = threshold0;
    Bitmap sourceImg = sourceImg0;
    Mesh baseMesh = baseMesh0;
    Rectangle3d r = r0;
    double edgeSegmentLength = edgeSegmentLength0;
    double maxSkeletonLength = maxSkeletonLength0;

    List<Point3d> extractedPoints = new List<Point3d>();
    Point3d[] rectCorners = r.BoundingBox.GetCorners();

    Polyline[] edges;
    for(int i = 0; i < baseMesh.Vertices.Count; i++){
      var pt = baseMesh.Vertices[i];
      Color rawColor = sourceImg.GetPixel(Convert.ToInt32((pt.X / r.Width) * (sourceImg.Width - 1)), Convert.ToInt32((pt.Y / r.Height) * (sourceImg.Height - 1)));
      baseMesh.Vertices.SetVertex(i, pt.X, pt.Y, rawColor.GetBrightness());
    }
    edges = Rhino.Geometry.Intersect.Intersection.MeshPlane(baseMesh, cutter);


    List<Node2> unit = new List<Node2>();
    Node2List nodes = new Node2List();

    for(int i = 0; i < edges.Length; i++){
      var edgesCrv = edges[i].ToPolylineCurve();
      for(int j = 0; j < (edgesCrv.Domain.Max - edgesCrv.Domain.Min) / edgeSegmentLength; j++){
        var tpt = edgesCrv.PointAt(j * edgeSegmentLength);
        unit.Add(new Node2(tpt.X, tpt.Y));
      }
    }

    foreach(Node2 a in unit){
      nodes.Append(a);
    }

    Node2List outline = new Node2List();
    foreach (Point3d p in rectCorners)
    {
      Node2 n = new Node2(p.X, p.Y);
      outline.Append(n);
    }

    var delaunay = Grasshopper.Kernel.Geometry.Delaunay.Solver.Solve_Connectivity(nodes, 0.1, false);
    var voronoi = Grasshopper.Kernel.Geometry.Voronoi.Solver.Solve_Connectivity(nodes, delaunay, outline);


    List<Line> centralLine = new  List<Line>();
    List<Double> vs = new  List<Double>();
    List<Double> ve = new  List<Double>();
    List<Point3d> ps = new  List<Point3d>();
    List<Point3d> pe = new  List<Point3d>();
    foreach( var c in voronoi)
    {
      Polyline pl = c.ToPolyline();
      var seg = pl.GetSegments();

      foreach( Line l in seg){
        var pStart = sourceImg.GetPixel(Convert.ToInt32((l.From.X / r.Width) * (sourceImg.Width - 1)), Convert.ToInt32((l.From.Y / r.Height) * (sourceImg.Height - 1)));
        var pEnd = sourceImg.GetPixel(Convert.ToInt32((l.To.X / r.Width) * (sourceImg.Width - 1)), Convert.ToInt32((l.To.Y / r.Height) * (sourceImg.Height - 1)));
        var pMid = sourceImg.GetPixel(Convert.ToInt32((0.5 * (l.From.X + l.To.X) / r.Width) * (sourceImg.Width - 1)), Convert.ToInt32((0.5 * (l.From.Y + l.To.Y) / r.Height) * (sourceImg.Height - 1)));

        if(pStart.GetBrightness() >= threshold && pMid.GetBrightness() >= threshold && pEnd.GetBrightness() >= threshold && l.Length < maxSkeletonLength){
          centralLine.Add(l);
        }
      }
    }
    result = centralLine;
  }
# ---------- end c_script ----------
panel = Panel(c_script.out)  # disabled
pt_4 = ConstructPoint(XCoordinate=number_slider_20, YCoordinate=number_slider_21, ZCoordinate=number_slider_19)  # disabled
scale = Scale(Center=data_2, Factor=number_slider_26)  # -> Geometry, Transform; disabled
scale_nu = ScaleNU(Geometry=center_4.Center, Plane=data_2, ScaleX=number_slider_23, ScaleY=number_slider_24, ScaleZ=number_slider_25)  # -> Geometry, Transform; disabled
data_4 = Data(pt_3)
rectangle_5 = Rectangle(Plane=PlaneXY(0, 0, 0), XSize=number_slider_27, YSize=number_slider_27, Radius=0)  # -> Rectangle, Length
Z = UnitZ(Factor=Slider(209, range=0..1000))
number_slider_37 = Slider(1, range=0.9..1.1)  # disabled
rotate_2 = Rotate(Angle=number_slider_13, Plane=data_2)  # -> Geometry, Transform; disabled
center_6 = Center(Geometric=rectangle_4.Rectangle)  # -> Center, Dimension; disabled
orient_2 = Orient(Geometry=textc_2, Source=center_2.Center, Target=center_6.Center)  # -> Geometry, Transform; disabled
cpoly_2 = ControlPolygon(Curve=orient_2.Geometry)  # -> Polygon, Points; disabled
pline_2 = PolyLine(Vertices=cpoly_2.Points, Closed=False)  # disabled
explode_2 = Explode(Curve=pline_2, Recursive=True)  # -> Segments, Vertices; disabled
data_5 = Data(flatten(explode_2.Segments))  # disabled
line_2 = Line(data_5)  # disabled
center_7 = Center(Geometric=line_2, forall=True)  # -> Center, Dimension; disabled
rotate_3 = Rotate(Geometry=line_2, Angle=number_slider_32, Plane=center_7.Center)  # -> Geometry, Transform; disabled
curvepoint_2 = PointOnCurve(rotate_3.Geometry, parameter=1)  # disabled
number_slider_38 = Slider(1, range=0.9..1.1)  # disabled
number_slider_39 = Slider(1, range=0.9..1.1)  # disabled
number_slider_40 = Slider(1, range=0.9..1.1)  # disabled
mplane_4 = MeshPlane(Boundary=rectangle_4.Rectangle, WidthCount=number_slider_28, HeightCount=number_slider_28)  # -> Mesh, Area; disabled
dom = ConstructDomain(DomainStart=number_slider_30, DomainEnd=number_slider_31)  # disabled
number_slider_41 = Slider(15, range=0..100)  # disabled
pt_5 = ConstructPoint(XCoordinate=Slider(0, range=-10..10), YCoordinate=Slider(0, range=-10..10), ZCoordinate=Slider(0, range=0..10))
number_slider_42 = Slider(0.5, range=0..1)  # disabled
number_slider_43 = Slider(4, range=0..100)  # disabled
number_slider_44 = Slider(3, range=0..100)  # disabled
number_slider_45 = Slider(0.5, range=0..1)  # disabled
number_slider_46 = Slider(1000, range=0..1000)  # disabled
number_slider_47 = Slider(3, range=0..100)  # disabled
center_8 = Center(Geometric=rectangle_5.Rectangle)  # -> Center, Dimension
orient_3 = Orient(Geometry=textc_3, Source=center_3.Center, Target=center_8.Center)  # -> Geometry, Transform; disabled
cpoly_3 = ControlPolygon(Curve=orient_3.Geometry)  # -> Polygon, Points; disabled
pline_3 = PolyLine(Vertices=cpoly_3.Points, Closed=False)  # disabled
explode_3 = Explode(Curve=pline_3, Recursive=True)  # -> Segments, Vertices; disabled
data_6 = Data(flatten(explode_3.Segments))  # disabled
line_3 = Line(data_6)  # disabled
center_9 = Center(Geometric=line_3, forall=True)  # -> Center, Dimension; disabled
rotate_4 = Rotate(Geometry=line_3, Angle=number_slider_36, Plane=center_9.Center)  # -> Geometry, Transform; disabled
curvepoint_3 = PointOnCurve(rotate_4.Geometry, parameter=1)  # disabled
button_2 = Button()  # disabled
center_10 = Center(Geometric=mplane.Mesh)  # -> Center, Dimension
path_2 = FilePath("C:\Users\RT-01\Desktop\Test.jpg")  # disabled
move_3 = Move(Geometry=center_10.Center, Motion=Z)  # -> Geometry, Transform
mplane_5 = MeshPlane(Boundary=rectangle_5.Rectangle, WidthCount=number_slider_33, HeightCount=number_slider_33)  # -> Mesh, Area
comp = Compound(Transforms=flatten([scale_nu.Transform, rotate_2.Transform, move.Transform]))  # disabled
data_7 = Data(c_script.A)  # disabled
path_3 = FilePath("C:\Users\Yufan\Desktop\TestImg.jpg")  # disabled
remap = RemapNumbers(Value=number_slider_35, Source=Domain(0, 1), Target=dom)  # -> Mapped, Clipped; disabled
group = Group(Objects=data_7)  # disabled
move_4 = Move(Motion=pt_4)  # -> Geometry, Transform; disabled
number_slider_48 = Slider(1, range=0..1)  # disabled
trigger_2 = Trigger(Interval=1, TimerInterval=5, Target=c_script_3)  # disabled
number_slider_49 = Slider(1, range=0..1)  # disabled
Y = UnitY(Factor=1)
scale_2 = Scale(Center=data_3, Factor=number_slider_40)  # -> Geometry, Transform; disabled
scale_nu_2 = ScaleNU(Geometry=center_6.Center, Plane=data_3, ScaleX=number_slider_37, ScaleY=number_slider_38, ScaleZ=number_slider_39)  # -> Geometry, Transform; disabled
move_5 = Move(Geometry=line_2, Motion=Vector(0, 0, 10))  # -> Geometry, Transform; disabled
move_6 = Move(Motion=pt_5)  # -> Geometry, Transform
int = Integer(expr("X-1", number_slider_46))  # disabled
rotate_5 = Rotate(Angle=number_slider_29, Plane=data_3)  # -> Geometry, Transform; disabled
rec = DataRecorder(group, DataLimit=-10, RecordData=True)  # disabled
data_8 = Data(flatten(rec))  # disabled
lng = ListLength(List=data_8)  # -> expr("X-1", Length); disabled
neg = Negative(Value=Y)
c_script_2 = CSharpScript(
    file=path_2,
    baseMesh=mplane_2.Mesh,
    bound=rectangle_2.Rectangle,
    strokeSize=number_slider_44,
    threshold=number_slider_45,
    edgeSegmentLength=number_slider_47,
    iter=number_slider_46)  # -> out, A; inputs file: String, baseMesh: Mesh, bound: Rectangle3d, strokeSize: Double, threshold: Double, edgeSegmentLength: Double, iter: Int32; disabled
# ---------- c_script_2: C# ----------
    Bitmap sourceImg = new Bitmap(file);
    var rw = sourceImg.Width;
    var rh = sourceImg.Height;

    Bitmap iterImg = sourceImg.Clone(new Rectangle(0, 0, rw, rh), sourceImg.PixelFormat);
    Graphics canvas = Graphics.FromImage(iterImg);
    List<Line> lines = new List<Line>();
    Grasshopper.DataTree<Line> process = new Grasshopper.DataTree<Line>();

    //Drawing setup - pen and shape
    Pen pen = new Pen(Color.White, Convert.ToSingle(rw * strokeSize / bound.Width));
    pen.StartCap = System.Drawing.Drawing2D.LineCap.Round;
    pen.EndCap = System.Drawing.Drawing2D.LineCap.Round;

    //Skeletonize and draw on iterImg with skeleton trails, and record skeleton result
    for(int i = 0; i < iter; i++){
      lines.Clear();
      Extract(threshold, iterImg, baseMesh, bound, edgeSegmentLength, pen.Width, ref lines);
      canvas.Clear(Color.Black);

      foreach(Line l in lines){
        canvas.DrawLine(pen, Convert.ToInt32(rw * (l.From.X - bound.X.Min) / bound.Width), Convert.ToInt32(rh * (l.From.Y - bound.Y.Min) / bound.Height), Convert.ToInt32(rw * (l.To.X - bound.X.Min) / bound.Width), Convert.ToInt32(rh * (l.To.Y - bound.Y.Min) / bound.Height));
        Print("a");
      }
      process.AddRange(lines, new Grasshopper.Kernel.Data.GH_Path(i));
    }
    A = process;
# ---------- c_script_2: C# additional code ----------
  Rhino.Geometry.Plane cutter = new Rhino.Geometry.Plane(new Point3d(0, 0, 0.5), new Vector3d(0, 0, 1));

  public void Extract(double threshold0, Bitmap sourceImg0, Mesh baseMesh0, Rectangle3d r0, double edgeSegmentLength0, double maxSkeletonLength0, ref List<Line> result){
    double threshold = threshold0;
    Bitmap sourceImg = sourceImg0;
    Mesh baseMesh = baseMesh0;
    Rectangle3d r = r0;
    double edgeSegmentLength = edgeSegmentLength0;
    double maxSkeletonLength = maxSkeletonLength0;

    List<Point3d> extractedPoints = new List<Point3d>();
    Point3d[] rectCorners = r.BoundingBox.GetCorners();

    Polyline[] edges;
    for(int i = 0; i < baseMesh.Vertices.Count; i++){
      var pt = baseMesh.Vertices[i];
      Color rawColor = sourceImg.GetPixel(Convert.ToInt32((pt.X / r.Width) * (sourceImg.Width - 1)), Convert.ToInt32((pt.Y / r.Height) * (sourceImg.Height - 1)));
      baseMesh.Vertices.SetVertex(i, pt.X, pt.Y, rawColor.GetBrightness());
    }
    edges = Rhino.Geometry.Intersect.Intersection.MeshPlane(baseMesh, cutter);


    List<Node2> unit = new List<Node2>();
    Node2List nodes = new Node2List();

    for(int i = 0; i < edges.Length; i++){
      var edgesCrv = edges[i].ToPolylineCurve();
      for(int j = 0; j < (edgesCrv.Domain.Max - edgesCrv.Domain.Min) / edgeSegmentLength; j++){
        var tpt = edgesCrv.PointAt(j * edgeSegmentLength);
        unit.Add(new Node2(tpt.X, tpt.Y));
      }
    }

    foreach(Node2 a in unit){
      nodes.Append(a);
    }

    Node2List outline = new Node2List();
    foreach (Point3d p in rectCorners)
    {
      Node2 n = new Node2(p.X, p.Y);
      outline.Append(n);
    }

    var delaunay = Grasshopper.Kernel.Geometry.Delaunay.Solver.Solve_Connectivity(nodes, 0.1, false);
    var voronoi = Grasshopper.Kernel.Geometry.Voronoi.Solver.Solve_Connectivity(nodes, delaunay, outline);


    List<Line> centralLine = new  List<Line>();
    List<Double> vs = new  List<Double>();
    List<Double> ve = new  List<Double>();
    List<Point3d> ps = new  List<Point3d>();
    List<Point3d> pe = new  List<Point3d>();
    foreach( var c in voronoi)
    {
      Polyline pl = c.ToPolyline();
      var seg = pl.GetSegments();

      foreach( Line l in seg){
        var pStart = sourceImg.GetPixel(Convert.ToInt32((l.From.X / r.Width) * (sourceImg.Width - 1)), Convert.ToInt32((l.From.Y / r.Height) * (sourceImg.Height - 1)));
        var pEnd = sourceImg.GetPixel(Convert.ToInt32((l.To.X / r.Width) * (sourceImg.Width - 1)), Convert.ToInt32((l.To.Y / r.Height) * (sourceImg.Height - 1)));
        var pMid = sourceImg.GetPixel(Convert.ToInt32((0.5 * (l.From.X + l.To.X) / r.Width) * (sourceImg.Width - 1)), Convert.ToInt32((0.5 * (l.From.Y + l.To.Y) / r.Height) * (sourceImg.Height - 1)));

        if(pStart.GetBrightness() >= threshold && pMid.GetBrightness() >= threshold && pEnd.GetBrightness() >= threshold && l.Length < maxSkeletonLength){
          centralLine.Add(l);
        }
      }
    }
    result = centralLine;
  }
# ---------- end c_script_2 ----------
number_slider_50 = Slider(0.966, range=0..1)  # disabled
scale_3 = Scale(Center=data_4, Factor=Slider(1, range=0.9..1.1))  # -> Geometry, Transform
scale_nu_3 = ScaleNU(
    Geometry=center_8.Center,
    Plane=data_4,
    ScaleX=Slider(1, range=0.9..1.1),
    ScaleY=Slider(1, range=0.9..1.1),
    ScaleZ=Slider(1, range=0.9..1.1))  # -> Geometry, Transform
move_7 = Move(Geometry=line_3, Motion=Vector(0, 0, 10))  # -> Geometry, Transform; disabled
c_script_3 = CSharpScript(
    file=path_3,
    baseMesh=mplane_3.Mesh,
    bound=rectangle_3.Rectangle,
    strokeSize=number_slider_41,
    threshold=number_slider_42,
    edgeSegmentLength=number_slider_43,
    transform=comp,
    constantFeed=rotate.Geometry,
    reset=button_2)  # -> out, A; inputs file: String, baseMesh: Mesh, bound: Rectangle3d, strokeSize: Double, threshold: Double, edgeSegmentLength: Double, transform: Transform, constantFeed: list of Line, reset: Boolean; disabled
# ---------- c_script_3: C# ----------
    if (counter == 0){
      sourceImg = new Bitmap(file);
      rw = sourceImg.Width;
      rh = sourceImg.Height;

      iterImg = sourceImg.Clone(new Rectangle(0, 0, rw, rh), sourceImg.PixelFormat);
      canvas = Graphics.FromImage(iterImg);
      lines = new List<Line>();
      process = new Grasshopper.DataTree<Line>();
    }
    counter++;

    if(reset){
      counter = 0;
    }

    //Drawing setup - pen and shape
    pen = new Pen(Color.White, Convert.ToSingle(rw * strokeSize / bound.Width));
    pen.StartCap = System.Drawing.Drawing2D.LineCap.Round;
    pen.EndCap = System.Drawing.Drawing2D.LineCap.Round;

    //Skeletonize and draw on iterImg with skeleton trails
    lines.Clear();
    try{
      Extract(threshold, iterImg, baseMesh, bound, edgeSegmentLength, strokeSize, ref lines);
      canvas.Clear(Color.Black);

      foreach(Line l in lines){
        l.Transform(transform);
        canvas.DrawLine(pen, Convert.ToInt32(rw * (l.From.X - bound.X.Min) / bound.Width), Convert.ToInt32(rh * (l.From.Y - bound.Y.Min) / bound.Height), Convert.ToInt32(rw * (l.To.X - bound.X.Min) / bound.Width), Convert.ToInt32(rh * (l.To.Y - bound.Y.Min) / bound.Height));
      }
    }
    catch(Exception exMsg){
      Print(exMsg.Message);
      counter = 0;
    }

    foreach(Line l in constantFeed){
      canvas.DrawLine(pen, Convert.ToInt32(rw * (l.From.X - bound.X.Min) / bound.Width), Convert.ToInt32(rh * (l.From.Y - bound.Y.Min) / bound.Height), Convert.ToInt32(rw * (l.To.X - bound.X.Min) / bound.Width), Convert.ToInt32(rh * (l.To.Y - bound.Y.Min) / bound.Height));
    }
    Print(counter.ToString());
    A = lines;
# ---------- c_script_3: C# additional code ----------
  Rhino.Geometry.Plane cutter = new Rhino.Geometry.Plane(new Point3d(0, 0, 0.5), new Vector3d(0, 0, 1));
  Bitmap sourceImg;
  Bitmap iterImg;
  Graphics canvas;
  int rw;
  int rh;
  List<Line> lines;
  Grasshopper.DataTree<Line> process;
  Pen pen;


  int counter = 0;
  public void Extract(double threshold0, Bitmap sourceImg0, Mesh baseMesh0, Rectangle3d r0, double edgeSegmentLength0, double maxSkeletonLength0, ref List<Line> result){
    double threshold = threshold0;
    Bitmap sourceImg = sourceImg0;
    Mesh baseMesh = baseMesh0;
    Rectangle3d r = r0;
    double edgeSegmentLength = edgeSegmentLength0;
    double maxSkeletonLength = maxSkeletonLength0;

    List<Point3d> extractedPoints = new List<Point3d>();
    Point3d[] rectCorners = r.BoundingBox.GetCorners();

    Polyline[] edges;
    for(int i = 0; i < baseMesh.Vertices.Count; i++){
      var pt = baseMesh.Vertices[i];
      Color rawColor = sourceImg.GetPixel(Math.Min(Convert.ToInt32((pt.X / r.Width) * sourceImg.Width), sourceImg.Width - 1), Math.Min(Convert.ToInt32((pt.Y / r.Height) * sourceImg.Height), sourceImg.Height - 1));
      baseMesh.Vertices.SetVertex(i, pt.X, pt.Y, rawColor.GetBrightness());
    }
    edges = Rhino.Geometry.Intersect.Intersection.MeshPlane(baseMesh, cutter);


    List<Node2> unit = new List<Node2>();
    Node2List nodes = new Node2List();

    for(int i = 0; i < edges.Length; i++){
      var edgesCrv = edges[i].ToPolylineCurve();
      for(int j = 0; j < (edgesCrv.Domain.Max - edgesCrv.Domain.Min) / edgeSegmentLength; j++){
        var tpt = edgesCrv.PointAt(j * edgeSegmentLength);
        unit.Add(new Node2(tpt.X, tpt.Y));
      }
    }

    foreach(Node2 a in unit){
      nodes.Append(a);
    }

    Node2List outline = new Node2List();
    foreach (Point3d p in rectCorners)
    {
      Node2 n = new Node2(p.X, p.Y);
      outline.Append(n);
    }

    var delaunay = Grasshopper.Kernel.Geometry.Delaunay.Solver.Solve_Connectivity(nodes, 0.1, false);
    var voronoi = Grasshopper.Kernel.Geometry.Voronoi.Solver.Solve_Connectivity(nodes, delaunay, outline);


    List<Line> centralLine = new  List<Line>();
    List<Double> vs = new  List<Double>();
    List<Double> ve = new  List<Double>();
    List<Point3d> ps = new  List<Point3d>();
    List<Point3d> pe = new  List<Point3d>();
    foreach( var c in voronoi)
    {
      Polyline pl = c.ToPolyline();
      var seg = pl.GetSegments();

      foreach( Line l in seg){
        var pStart = sourceImg.GetPixel(Convert.ToInt32((l.From.X / r.Width) * (sourceImg.Width - 1)), Convert.ToInt32((l.From.Y / r.Height) * (sourceImg.Height - 1)));
        var pEnd = sourceImg.GetPixel(Convert.ToInt32((l.To.X / r.Width) * (sourceImg.Width - 1)), Convert.ToInt32((l.To.Y / r.Height) * (sourceImg.Height - 1)));
        var pMid = sourceImg.GetPixel(Convert.ToInt32((0.5 * (l.From.X + l.To.X) / r.Width) * (sourceImg.Width - 1)), Convert.ToInt32((0.5 * (l.From.Y + l.To.Y) / r.Height) * (sourceImg.Height - 1)));

        if(pStart.GetBrightness() >= threshold && pMid.GetBrightness() >= threshold && pEnd.GetBrightness() >= threshold && l.Length < maxSkeletonLength){
          centralLine.Add(l);
        }
      }
    }
    result = centralLine;
  }
# ---------- end c_script_3 ----------
panel_2 = Panel(c_script_3.out)  # disabled
rotate_6 = Rotate(Angle=Slider(0, range=-0.1..0.1), Plane=data_4)  # -> Geometry, Transform
multiplication = Multiplication(A=int, B=number_slider_48)  # disabled
explode_4 = Explode(Curve=rectangle_4.Rectangle, Recursive=True)  # -> Segments, Vertices; disabled
multiplication_2 = Multiplication(A=lng, B=number_slider_49)  # disabled
comp_2 = Compound(Transforms=flatten([scale_nu_2.Transform, rotate_5.Transform, move_4.Transform]))  # disabled
center_11 = Center(Geometric=rectangle_4.Rectangle)  # -> Center, Dimension; disabled
camera = CameraCrane(Location=move_3.Geometry, Target=center_10.Center, UPVector=neg, View=0, Refresh=True)  # -> Camera, Target, Lens, Up, HorizontalViewAngle, VerticalViewAngle, ScreenRatio, Frame
explode_5 = Explode(Curve=rectangle_5.Rectangle, Recursive=True)  # -> Segments, Vertices
comp_3 = Compound(Transforms=flatten([scale_nu_3.Transform, rotate_6.Transform, move_6.Transform]))
center_12 = Center(Geometric=rectangle_5.Rectangle)  # -> Center, Dimension
item_4 = ListItem(List=data_8, Index=multiplication_2, Wrap=True)  # disabled
number_slider_51 = Slider(0.4016, range=0..1)  # disabled
number_slider_52 = Slider(16, range=0..100)  # disabled
number_slider_53 = Slider(0.5, range=0..1)  # disabled
data_9 = Data(c_script_3.A)  # disabled
scale_4 = Scale(Geometry=explode_4.Segments, Center=center_11.Center, Factor=number_slider_50)  # -> Geometry, Transform; disabled
number_slider_54 = Slider(12, range=0..100)  # disabled
group_2 = Group(Objects=data_9)  # disabled
branch = TreeBranch(Tree=simplify(c_script_2.A), Path=multiplication, MaintainPaths=True)  # disabled
number_slider_55 = Slider(0.48553, range=0..1)  # disabled
button_3 = Button()  # disabled
number_slider_56 = Slider(0.5267236, range=0..1)  # disabled
ungroup = Ungroup(Group=item_4)  # disabled
number_slider_57 = Slider(8, range=0..100)
neg_2 = Negative(Value=number_slider_51)  # disabled
number_slider_58 = Slider(7, range=0..10)  # disabled
scale_5 = Scale(Geometry=explode_5.Segments, Center=center_12.Center, Factor=Slider(0.966, range=0..1))  # -> Geometry, Transform
rec_2 = DataRecorder(group_2, DataLimit=-10, RecordData=True)  # disabled
data_10 = Data(flatten(rec_2))  # disabled
lng_2 = ListLength(List=data_10)  # -> expr("X-1", Length); disabled
multiplication_3 = Multiplication(A=lng_2, B=remap.Mapped)  # disabled
item_5 = ListItem(List=data_10, Index=multiplication_3, Wrap=True)  # disabled
ungroup_2 = Ungroup(Group=item_5)  # disabled
trigger_3 = Trigger(Interval=1, TimerInterval=5, Target=c_script_4)  # disabled
number_slider_59 = Slider(1, range=0..10)  # disabled
swatch = ColourSwatch(SwatchColor=RGB(0, 0, 0))  # disabled
offset = OffsetCurve(Curve=branch, Distance=number_slider_51, Corners=1)  # disabled
offset_2 = OffsetCurve(Curve=branch, Distance=neg_2, Corners=1)  # disabled
trigger_4 = Trigger(Interval=1, TimerInterval=5, Target=c_script_5)  # disabled
number_slider_60 = Slider(2, range=0..10)  # disabled
swatch_2 = ColourSwatch(SwatchColor=RGB(0, 0, 0))  # disabled
path_4 = FilePath("D:\XYF\PROJECT_PERSONAL\SkeletonBasedPhysarumSystem\20211201_CSystem\Mask_B_Rect1.png")  # disabled
number_slider_61 = Slider(0.4016, range=0..1)  # disabled
divlength = DivideLength(Curve=ungroup_2, Length=number_slider_55)  # -> Points, Tangents, Parameters; disabled
path_5 = FilePath("D:\XYF\PROJECT_PERSONAL\SkeletonBasedPhysarumSystem\20211201_CSystem\Mask_W_Rect1.png")  # disabled
number_slider_62 = Slider(0.4016, range=0..1)  # disabled
number_slider_63 = Slider(0.999, range=0..1)  # disabled
path_6 = FilePath("D:\XYF\PROJECT_PERSONAL\SkeletonBasedPhysarumSystem\20211201_CSystem\Mask_B_Rect1.png")
neg_3 = Negative(Value=number_slider_61)  # disabled
path_7 = FilePath("D:\XYF\PROJECT_PERSONAL\SkeletonBasedPhysarumSystem\20211201_CSystem\Mask_W_Rect1.png")
center_13 = Center(Geometric=rectangle_4.Rectangle)  # -> Center, Dimension; disabled
number_slider_64 = Slider(0.584, range=0..1)  # disabled
neg_4 = Negative(Value=number_slider_62)  # disabled
previewlw = CustomPreviewLineweights(Geometry=[offset, offset_2], Shader=swatch, Thickness=number_slider_59, Absolute=False)  # disabled
c_script_4 = CSharpScript(
    file=path_5,
    baseMesh=mplane_4.Mesh,
    bound=rectangle_4.Rectangle,
    strokeSize=number_slider_52,
    threshold=number_slider_53,
    edgeSegmentLength=number_slider_54,
    transform=comp_2,
    constantFeed=scale_4.Geometry,
    reset=button_3)  # -> out, A; inputs file: String, baseMesh: Mesh, bound: Rectangle3d, strokeSize: Double, threshold: Double, edgeSegmentLength: Double, transform: Transform, constantFeed: list of Line, environmentImage: String, reset: Boolean; disabled
# ---------- c_script_4: C# ----------
    if (counter == 0){
      sourceImg = new Bitmap(file);
      rw = sourceImg.Width;
      rh = sourceImg.Height;

      iterImg = sourceImg.Clone(new Rectangle(0, 0, rw, rh), System.Drawing.Imaging.PixelFormat.Format32bppPArgb);
      canvas = Graphics.FromImage(iterImg);
      lines = new List<Line>();
      process = new Grasshopper.DataTree<Line>();
    }
    counter++;

    if(reset){
      counter = 0;
    }
    
    //Drawing setup - pen and shape
    pen = new Pen(Color.White, Convert.ToSingle(rw * strokeSize / bound.Width));
    pen.StartCap = System.Drawing.Drawing2D.LineCap.Round;
    pen.EndCap = System.Drawing.Drawing2D.LineCap.Round;

    //Skeletonize and draw on iterImg with skeleton trails
    lines.Clear();
    try{
      Extract(threshold, iterImg, baseMesh, bound, edgeSegmentLength, strokeSize, ref lines);
      canvas.Clear(Color.Black);

      foreach(Line l in lines){
        l.Transform(transform);
        canvas.DrawLine(pen, Convert.ToInt32(rw * (l.From.X - bound.X.Min) / bound.Width), Convert.ToInt32(rh * (l.From.Y - bound.Y.Min) / bound.Height), Convert.ToInt32(rw * (l.To.X - bound.X.Min) / bound.Width), Convert.ToInt32(rh * (l.To.Y - bound.Y.Min) / bound.Height));
      }
    }
    catch(Exception exMsg){
      Print(exMsg.Message);
      counter = 0;
    }

    foreach(Line l in constantFeed){
      canvas.DrawLine(pen, Convert.ToInt32(rw * (l.From.X - bound.X.Min) / bound.Width), Convert.ToInt32(rh * (l.From.Y - bound.Y.Min) / bound.Height), Convert.ToInt32(rw * (l.To.X - bound.X.Min) / bound.Width), Convert.ToInt32(rh * (l.To.Y - bound.Y.Min) / bound.Height));
    }
    
    //Overlay environment image
    try{
      canvas.DrawImage(environmentImg, new Rectangle(0, 0, rw, rh));
      environmentImg = new Bitmap(environmentImage);
    }
    catch(Exception exMsg){
      Print(exMsg.Message);
    }
    
    Print(counter.ToString());
    A = lines;
# ---------- c_script_4: C# additional code ----------
  Rhino.Geometry.Plane cutter = new Rhino.Geometry.Plane(new Point3d(0, 0, 0.5), new Vector3d(0, 0, 1));
  Bitmap sourceImg;
  Bitmap iterImg;
  Bitmap environmentImg;
  Graphics canvas;
  int rw;
  int rh;
  List<Line> lines;
  Grasshopper.DataTree<Line> process;
  Pen pen;


  int counter = 0;
  public void Extract(double threshold0, Bitmap sourceImg0, Mesh baseMesh0, Rectangle3d r0, double edgeSegmentLength0, double maxSkeletonLength0, ref List<Line> result){
    double threshold = threshold0;
    Bitmap sourceImg = sourceImg0;
    Mesh baseMesh = baseMesh0;
    Rectangle3d r = r0;
    double edgeSegmentLength = edgeSegmentLength0;
    double maxSkeletonLength = maxSkeletonLength0;

    List<Point3d> extractedPoints = new List<Point3d>();
    Point3d[] rectCorners = r.BoundingBox.GetCorners();

    Polyline[] edges;
    for(int i = 0; i < baseMesh.Vertices.Count; i++){
      var pt = baseMesh.Vertices[i];
      Color rawColor = sourceImg.GetPixel(Math.Min(Convert.ToInt32((pt.X / r.Width) * sourceImg.Width), sourceImg.Width - 1), Math.Min(Convert.ToInt32((pt.Y / r.Height) * sourceImg.Height), sourceImg.Height - 1));
      baseMesh.Vertices.SetVertex(i, pt.X, pt.Y, rawColor.GetBrightness());
    }
    edges = Rhino.Geometry.Intersect.Intersection.MeshPlane(baseMesh, cutter);


    List<Node2> unit = new List<Node2>();
    Node2List nodes = new Node2List();

    for(int i = 0; i < edges.Length; i++){
      var edgesCrv = edges[i].ToPolylineCurve();
      for(int j = 0; j < (edgesCrv.Domain.Max - edgesCrv.Domain.Min) / edgeSegmentLength; j++){
        var tpt = edgesCrv.PointAt(j * edgeSegmentLength);
        unit.Add(new Node2(tpt.X, tpt.Y));
      }
    }

    foreach(Node2 a in unit){
      nodes.Append(a);
    }

    Node2List outline = new Node2List();
    foreach (Point3d p in rectCorners)
    {
      Node2 n = new Node2(p.X, p.Y);
      outline.Append(n);
    }

    var delaunay = Grasshopper.Kernel.Geometry.Delaunay.Solver.Solve_Connectivity(nodes, 0.1, false);
    var voronoi = Grasshopper.Kernel.Geometry.Voronoi.Solver.Solve_Connectivity(nodes, delaunay, outline);


    List<Line> centralLine = new  List<Line>();
    List<Double> vs = new  List<Double>();
    List<Double> ve = new  List<Double>();
    List<Point3d> ps = new  List<Point3d>();
    List<Point3d> pe = new  List<Point3d>();
    foreach( var c in voronoi)
    {
      Polyline pl = c.ToPolyline();
      var seg = pl.GetSegments();

      foreach( Line l in seg){
        var pStart = sourceImg.GetPixel(Convert.ToInt32((l.From.X / r.Width) * (sourceImg.Width - 1)), Convert.ToInt32((l.From.Y / r.Height) * (sourceImg.Height - 1)));
        var pEnd = sourceImg.GetPixel(Convert.ToInt32((l.To.X / r.Width) * (sourceImg.Width - 1)), Convert.ToInt32((l.To.Y / r.Height) * (sourceImg.Height - 1)));
        var pMid = sourceImg.GetPixel(Convert.ToInt32((0.5 * (l.From.X + l.To.X) / r.Width) * (sourceImg.Width - 1)), Convert.ToInt32((0.5 * (l.From.Y + l.To.Y) / r.Height) * (sourceImg.Height - 1)));

        if(pStart.GetBrightness() >= threshold && pMid.GetBrightness() >= threshold && pEnd.GetBrightness() >= threshold && l.Length < maxSkeletonLength){
          centralLine.Add(l);
        }
      }
    }
    result = centralLine;
  }
# ---------- end c_script_4 ----------
swatch_3 = ColourSwatch(SwatchColor=RGB(0, 0, 0))  # disabled
panel_3 = Panel(c_script_4.out)  # disabled
center_14 = Center(Geometric=rectangle_5.Rectangle)  # -> Center, Dimension
previewlw_2 = CustomPreviewLineweights(Geometry=ungroup, Shader=swatch_2, Thickness=number_slider_60, Absolute=False)  # disabled
emitter = PointEmitter(Emitter=divlength.Points, Radius=number_slider_56, Number=number_slider_58, Tendency=0.25)  # disabled
scale_6 = Scale(Geometry=rectangle_4.Rectangle, Center=center_13.Center, Factor=number_slider_63)  # -> Geometry, Transform; disabled
offset_3 = OffsetCurve(Curve=ungroup_2, Distance=number_slider_61, Corners=1)  # disabled
offset_4 = OffsetCurve(Curve=ungroup_2, Distance=neg_3, Corners=1)  # disabled
lng_3 = ListLength(List=c_script_2.A)  # disabled
lng_4 = ListLength(List=c_script_2.out)  # disabled
panel_4 = Panel(c_script_2.out)  # disabled
c_script_5 = CSharpScript(
    file=path_7,
    baseMesh=mplane_5.Mesh,
    bound=rectangle_5.Rectangle,
    strokeSize=number_slider_57,
    threshold=Slider(0.5, range=0..1),
    edgeSegmentLength=Slider(8, range=0..100),
    transform=comp_3,
    constantFeed=scale_5.Geometry,
    reset=Button())  # -> out, A; inputs file: String, baseMesh: Mesh, bound: Rectangle3d, strokeSize: Double, threshold: Double, edgeSegmentLength: Double, transform: Transform, constantFeed: list of Line, environmentImage: String, reset: Boolean
# ---------- c_script_5: C# ----------
    if (counter == 0){
      sourceImg = new Bitmap(file);
      rw = sourceImg.Width;
      rh = sourceImg.Height;

      iterImg = sourceImg.Clone(new Rectangle(0, 0, rw, rh), System.Drawing.Imaging.PixelFormat.Format32bppPArgb);
      canvas = Graphics.FromImage(iterImg);
      lines = new List<Line>();
      process = new Grasshopper.DataTree<Line>();
    }
    counter++;

    if(reset){
      counter = 0;
    }

    //Drawing setup - pen and shape
    pen = new Pen(Color.White, Convert.ToSingle(rw * strokeSize / bound.Width));
    pen.StartCap = System.Drawing.Drawing2D.LineCap.Triangle;
    pen.EndCap = System.Drawing.Drawing2D.LineCap.Triangle;

    //Skeletonize and draw on iterImg with skeleton trails
    lines.Clear();
    try{
      Extract(threshold, iterImg, baseMesh, bound, edgeSegmentLength, strokeSize, ref lines);
      canvas.Clear(Color.Black);

      foreach(Line l in lines){
        l.Transform(transform);
        canvas.DrawLine(pen, Convert.ToInt32(rw * (l.From.X - bound.X.Min) / bound.Width), Convert.ToInt32(rh * (l.From.Y - bound.Y.Min) / bound.Height), Convert.ToInt32(rw * (l.To.X - bound.X.Min) / bound.Width), Convert.ToInt32(rh * (l.To.Y - bound.Y.Min) / bound.Height));
      }
    }
    catch(Exception exMsg){
      Print(exMsg.Message);
      counter = 0;
    }

    foreach(Line l in constantFeed){
      canvas.DrawLine(pen, Convert.ToInt32(rw * (l.From.X - bound.X.Min) / bound.Width), Convert.ToInt32(rh * (l.From.Y - bound.Y.Min) / bound.Height), Convert.ToInt32(rw * (l.To.X - bound.X.Min) / bound.Width), Convert.ToInt32(rh * (l.To.Y - bound.Y.Min) / bound.Height));
    }

    //Overlay environment image
    try{
      canvas.DrawImage(environmentImg, new Rectangle(0, 0, rw, rh));
      environmentImg = new Bitmap(environmentImage);
    }
    catch(Exception exMsg){
      Print(exMsg.Message);
    }

    Print(counter.ToString());
    A = lines;
    iterImg.Save(@"D:\XYF\PROJECT_PERSONAL\SkeletonBasedPhysarumSystem\20211201_CSystem\iterImg.jpg");
# ---------- c_script_5: C# additional code ----------
  Rhino.Geometry.Plane cutter = new Rhino.Geometry.Plane(new Point3d(0, 0, 0.5), new Vector3d(0, 0, 1));
  Bitmap sourceImg;
  Bitmap iterImg;
  Bitmap environmentImg;
  Graphics canvas;
  int rw;
  int rh;
  List<Line> lines;
  Grasshopper.DataTree<Line> process;
  Pen pen;


  int counter = 0;
  public void Extract(double threshold0, Bitmap sourceImg0, Mesh baseMesh0, Rectangle3d r0, double edgeSegmentLength0, double maxSkeletonLength0, ref List<Line> result){
    double threshold = threshold0;
    Bitmap sourceImg = sourceImg0;
    Mesh baseMesh = baseMesh0;
    Rectangle3d r = r0;
    double edgeSegmentLength = edgeSegmentLength0;
    double maxSkeletonLength = maxSkeletonLength0;

    List<Point3d> extractedPoints = new List<Point3d>();
    Point3d[] rectCorners = r.BoundingBox.GetCorners();

    Polyline[] edges;
    for(int i = 0; i < baseMesh.Vertices.Count; i++){
      var pt = baseMesh.Vertices[i];
      Color rawColor = sourceImg.GetPixel(Math.Min(Convert.ToInt32((pt.X / r.Width) * sourceImg.Width), sourceImg.Width - 1), Math.Min(Convert.ToInt32((pt.Y / r.Height) * sourceImg.Height), sourceImg.Height - 1));
      baseMesh.Vertices.SetVertex(i, pt.X, pt.Y, rawColor.GetBrightness());
    }
    edges = Rhino.Geometry.Intersect.Intersection.MeshPlane(baseMesh, cutter);


    List<Node2> unit = new List<Node2>();
    Node2List nodes = new Node2List();

    for(int i = 0; i < edges.Length; i++){
      var edgesCrv = edges[i].ToPolylineCurve();
      for(int j = 0; j < (edgesCrv.Domain.Max - edgesCrv.Domain.Min) / edgeSegmentLength; j++){
        var tpt = edgesCrv.PointAt(j * edgeSegmentLength);
        unit.Add(new Node2(tpt.X, tpt.Y));
      }
    }

    foreach(Node2 a in unit){
      nodes.Append(a);
    }

    Node2List outline = new Node2List();
    foreach (Point3d p in rectCorners)
    {
      Node2 n = new Node2(p.X, p.Y);
      outline.Append(n);
    }

    var delaunay = Grasshopper.Kernel.Geometry.Delaunay.Solver.Solve_Connectivity(nodes, 0.1, false);
    var voronoi = Grasshopper.Kernel.Geometry.Voronoi.Solver.Solve_Connectivity(nodes, delaunay, outline);


    List<Line> centralLine = new  List<Line>();
    List<Double> vs = new  List<Double>();
    List<Double> ve = new  List<Double>();
    List<Point3d> ps = new  List<Point3d>();
    List<Point3d> pe = new  List<Point3d>();
    foreach( var c in voronoi)
    {
      Polyline pl = c.ToPolyline();
      var seg = pl.GetSegments();

      foreach( Line l in seg){
        var pStart = sourceImg.GetPixel(Convert.ToInt32((l.From.X / r.Width) * (sourceImg.Width - 1)), Convert.ToInt32((l.From.Y / r.Height) * (sourceImg.Height - 1)));
        var pEnd = sourceImg.GetPixel(Convert.ToInt32((l.To.X / r.Width) * (sourceImg.Width - 1)), Convert.ToInt32((l.To.Y / r.Height) * (sourceImg.Height - 1)));
        var pMid = sourceImg.GetPixel(Convert.ToInt32((0.5 * (l.From.X + l.To.X) / r.Width) * (sourceImg.Width - 1)), Convert.ToInt32((0.5 * (l.From.Y + l.To.Y) / r.Height) * (sourceImg.Height - 1)));

        if(pStart.GetBrightness() >= threshold && pMid.GetBrightness() >= threshold && pEnd.GetBrightness() >= threshold && l.Length < maxSkeletonLength){
          centralLine.Add(l);
        }
      }
    }
    result = centralLine;
  }
# ---------- end c_script_5 ----------
offset_5 = OffsetCurve(Curve=ungroup, Distance=number_slider_62, Corners=1)  # disabled
panel_5 = Panel(c_script_2.A)  # disabled
offset_6 = OffsetCurve(Curve=ungroup, Distance=neg_4, Corners=1)  # disabled
swatch_4 = ColourSwatch(SwatchColor=RGB(0, 0, 0))  # disabled
scale_7 = Scale(Geometry=rectangle_5.Rectangle, Center=center_14.Center, Factor=Slider(0.999, range=0..1))  # -> Geometry, Transform
xy = XYPlane(Origin=Point(0, 0, 0))  # disabled
panel_6 = Panel(c_script_5.out)
swatch_5 = ColourSwatch(SwatchColor=RGB(0, 0, 0))  # disabled
panel_7 = Panel(lng_3)  # disabled
panel_8 = Panel(lng_4)  # disabled
data_11 = Data(c_script_4.A)  # disabled
trim = TrimWithRegion(Curve=data_11, Region=scale_6.Geometry, Plane=xy)  # -> Inside, Outside; disabled
xy_2 = XYPlane(Origin=Point(0, 0, 0))
symadv = SymbolAdvanced(
    Style=1,
    SizePrimary=number_slider_64,
    SizeSecondary=number_slider_64,
    Rotation=0,
    Fill=swatch_3,
    Edge=swatch_3,
    Width=2,
    Adjust=False)  # disabled
preview = CustomPreview(Geometry=scale_6.Geometry, Material=swatch_4)  # disabled
data_12 = Data(c_script_5.A)
group_3 = Group(Objects=data_11)  # disabled
trim_2 = TrimWithRegion(Curve=data_12, Region=scale_7.Geometry, Plane=xy_2)  # -> Inside, Outside
preview_2 = CustomPreview(Geometry=scale_7.Geometry, Material=ColourSwatch(SwatchColor=RGB(0, 0, 0)))
previewlw_3 = CustomPreviewLineweights(Geometry=trim.Inside, Shader=swatch_5, Thickness=number_slider_52, Absolute=False)  # disabled
group_4 = Group(Objects=data_12)  # disabled
symbol = SymbolDisplay(Location=emitter, Display=symadv)  # disabled
rec_3 = DataRecorder(group_3, DataLimit=-10, RecordData=True)  # disabled
number_slider_65 = Slider(2, range=0..10)  # disabled
swatch_6 = ColourSwatch(SwatchColor=RGB(0, 0, 0))  # disabled
previewlw_4 = CustomPreviewLineweights(Geometry=trim_2.Inside, Shader=ColourSwatch(SwatchColor=RGB(0, 0, 0)), Thickness=number_slider_57, Absolute=False)
number_slider_66 = Slider(0, range=0..1)  # disabled
number_slider_67 = Slider(1, range=0..1)  # disabled
rec_4 = DataRecorder(group_4, DataLimit=-10, RecordData=True)  # disabled
number_slider_68 = Slider(1, range=0..1)  # disabled
number_slider_69 = Slider(0, range=0..1)  # disabled
number_slider_70 = Slider(1, range=0..1)  # disabled
number_slider_71 = Slider(1, range=0..1)  # disabled
number_slider_72 = Slider(1, range=0..1)  # disabled
previewlw_5 = CustomPreviewLineweights(Geometry=ungroup_2, Shader=swatch_6, Thickness=number_slider_65, Absolute=False)  # disabled
number_slider_73 = Slider(1, range=0..1)  # disabled
dom_2 = ConstructDomain(DomainStart=number_slider_66, DomainEnd=number_slider_67)  # disabled
dom_3 = ConstructDomain(DomainStart=number_slider_69, DomainEnd=number_slider_70)  # disabled
data_13 = Data(flatten(rec_3))  # disabled
lng_5 = ListLength(List=data_13)  # -> expr("X-1", Length); disabled
remap_2 = RemapNumbers(Value=number_slider_71, Source=Domain(0, 1), Target=dom_2)  # -> Mapped, Clipped; disabled
data_14 = Data(flatten(rec_4))  # disabled
lng_6 = ListLength(List=data_14)  # -> expr("X-1", Length); disabled
remap_3 = RemapNumbers(Value=number_slider_73, Source=Domain(0, 1), Target=dom_3)  # -> Mapped, Clipped; disabled
multiplication_4 = Multiplication(A=lng_5, B=remap_2.Mapped)  # disabled
multiplication_5 = Multiplication(A=lng_6, B=remap_3.Mapped)  # disabled
item_6 = ListItem(List=data_13, Index=multiplication_4, Wrap=True)  # disabled
item_7 = ListItem(List=data_14, Index=multiplication_5, Wrap=True)  # disabled
number_slider_74 = Slider(0.48553, range=0..1)  # disabled
ungroup_3 = Ungroup(Group=item_6)  # disabled
number_slider_75 = Slider(0.5267236, range=0..1)  # disabled
number_slider_76 = Slider(6, range=0..10)  # disabled
number_slider_77 = Slider(0.48553, range=0..1)  # disabled
ungroup_4 = Ungroup(Group=item_7)  # disabled
number_slider_78 = Slider(0.5267236, range=0..1)  # disabled
number_slider_79 = Slider(2, range=0..10)  # disabled
number_slider_80 = Slider(6, range=0..10)  # disabled
swatch_7 = ColourSwatch(SwatchColor=RGB(0, 0, 0))  # disabled
number_slider_81 = Slider(2, range=0..10)  # disabled
divlength_2 = DivideLength(Curve=ungroup_3, Length=number_slider_74)  # -> Points, Tangents, Parameters; disabled
swatch_8 = ColourSwatch(SwatchColor=RGB(0, 0, 0))  # disabled
divlength_3 = DivideLength(Curve=ungroup_4, Length=number_slider_77)  # -> Points, Tangents, Parameters; disabled
number_slider_82 = Slider(0.584, range=0..1)  # disabled
previewlw_6 = CustomPreviewLineweights(Geometry=ungroup_3, Shader=swatch_7, Thickness=number_slider_79, Absolute=False)  # disabled
swatch_9 = ColourSwatch(SwatchColor=RGB(0, 0, 0))  # disabled
emitter_2 = PointEmitter(Emitter=divlength_2.Points, Radius=number_slider_75, Number=number_slider_76, Tendency=0.25)  # disabled
number_slider_83 = Slider(0.584, range=0..1)  # disabled
previewlw_7 = CustomPreviewLineweights(Geometry=ungroup_4, Shader=swatch_8, Thickness=number_slider_81, Absolute=False)  # disabled
swatch_10 = ColourSwatch(SwatchColor=RGB(0, 0, 0))  # disabled
emitter_3 = PointEmitter(Emitter=divlength_3.Points, Radius=number_slider_78, Number=number_slider_80, Tendency=0.25)  # disabled
symadv_2 = SymbolAdvanced(
    Style=1,
    SizePrimary=number_slider_82,
    SizeSecondary=number_slider_82,
    Rotation=0,
    Fill=swatch_9,
    Edge=swatch_9,
    Width=2,
    Adjust=False)  # disabled
symadv_3 = SymbolAdvanced(
    Style=1,
    SizePrimary=number_slider_83,
    SizeSecondary=number_slider_83,
    Rotation=0,
    Fill=swatch_10,
    Edge=swatch_10,
    Width=2,
    Adjust=False)  # disabled
symbol_2 = SymbolDisplay(Location=emitter_2, Display=symadv_2)  # disabled
symbol_3 = SymbolDisplay(Location=emitter_3, Display=symadv_3)  # disabled
