# Grasshopper definition FeedbackSystem_Branch_output.gh (Grasshopper 1.0.7)
# plug-ins: Heteroptera, Human, Squid

number_slider = Slider(51, range=0..100)  # disabled
number_slider_2 = Slider(18, range=0..100)  # disabled
txt = Text(["A", "B", "C", "D", "E", "F", "G", "H", "I", "J", "K", "L", "M", "N", "O", "P", "Q", "R", "S", "T", "U", "V", "W", "X", "Y", "Z"])  # disabled
font = Font(Family="Arial", Size=number_slider, Bold=False, Italic=False, Underline=False)  # disabled
item = ListItem(List=txt, Index=number_slider_2, Wrap=True)  # disabled
number_slider_3 = Slider(51, range=0..100)  # disabled
number_slider_4 = Slider(18, range=0..100)  # disabled
textc = TextCurves(Plane=PlaneXY(0, 0, 0), Text=item, Font=font)  # disabled
txt_2 = Text(["A", "B", "C", "D", "E", "F", "G", "H", "I", "J", "K", "L", "M", "N", "O", "P", "Q", "R", "S", "T", "U", "V", "W", "X", "Y", "Z"])  # disabled
font_2 = Font(Family="Arial", Size=number_slider_3, Bold=False, Italic=False, Underline=False)  # disabled
center = Center(Geometric=textc, forall=True)  # -> Center, Dimension; disabled
item_2 = ListItem(List=txt_2, Index=number_slider_4, Wrap=True)  # disabled
textc_2 = TextCurves(Plane=PlaneXY(0, 0, 0), Text=item_2, Font=font_2)  # disabled
number_slider_5 = Slider(240, range=0..1000)
center_2 = Center(Geometric=textc_2, forall=True)  # -> Center, Dimension; disabled
number_slider_6 = Slider(100, range=0..100)
number_slider_7 = Slider(240, range=0..1000)
number_slider_8 = Slider(100, range=0..100)  # disabled
number_slider_9 = Slider(0, range=0..10)  # disabled
number_slider_10 = Slider(0, range=-10..10)  # disabled
number_slider_11 = Slider(0, range=-10..10)  # disabled
number_slider_12 = Slider(0, range=-0.1..0.1)  # disabled
crv = Curve([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])
rectangle = Rectangle(Plane=PlaneXY(0, 0, 0), XSize=number_slider_6, YSize=number_slider_6, Radius=0)  # -> Rectangle, Length
number_slider_13 = Slider(100, range=0..200)  # disabled
number_slider_14 = Slider(240, range=0..1000)  # disabled
number_slider_15 = Slider(0, range=0..10)  # disabled
mplane = MeshPlane(Boundary=rectangle.Rectangle, WidthCount=number_slider_7, HeightCount=number_slider_7)  # -> Mesh, Area
number_slider_16 = Slider(500, range=0..1000)  # disabled
len = Length(Curve=crv)
number_slider_17 = Slider(100, range=0..200)
data = Data(Slider(8, range=0..10))
rectangle_2 = Rectangle(Plane=PlaneXY(0, 0, 0), XSize=number_slider_8, YSize=number_slider_8, Radius=0)  # -> Rectangle, Length; disabled
number_slider_18 = Slider(8, range=0..24)  # disabled
number_slider_19 = Slider(1.02, range=0.9..1.1)  # disabled
pt = ConstructPoint(XCoordinate=0, YCoordinate=0, ZCoordinate=0)
pt_2 = ConstructPoint(XCoordinate=number_slider_10, YCoordinate=number_slider_11, ZCoordinate=number_slider_9)  # disabled
number_slider_20 = Slider(0.97, range=0.9..1.1)  # disabled
number_slider_21 = Slider(1, range=0.9..1.1)  # disabled
number_slider_22 = Slider(1, range=0.9..1.1)  # disabled
path = FilePath("C:\Users\RT-01\Desktop\Test.jpg")  # disabled
number_slider_23 = Slider(240, range=0..1000)
division = Division(A=len, B=Slider(4, range=0..10))
xy = XYPlane(Origin=Point(0, 0, 0.5))
xy_2 = XYPlane(Origin=Point(0, 0, 0))
number_slider_24 = Slider(0, range=0..1)  # disabled
rectangle_3 = Rectangle(Plane=PlaneXY(0, 0, 0), XSize=number_slider_13, YSize=number_slider_13, Radius=0)  # -> Rectangle, Length; disabled
center_3 = Center(Geometric=rectangle_3.Rectangle)  # -> Center, Dimension; disabled
orient = Orient(Geometry=textc, Source=center.Center, Target=center_3.Center)  # -> Geometry, Transform; disabled
cpoly = ControlPolygon(Curve=orient.Geometry)  # -> Polygon, Points; disabled
pline = PolyLine(Vertices=cpoly.Points, Closed=False)  # disabled
explode = Explode(Curve=pline, Recursive=True)  # -> Segments, Vertices; disabled
data_2 = Data(flatten(explode.Segments))  # disabled
line = Line(data_2)  # disabled
data_3 = Data(center_3.Center)  # disabled
center_4 = Center(Geometric=line, forall=True)  # -> Center, Dimension; disabled
rotate = Rotate(Geometry=line, Angle=number_slider_15, Plane=center_4.Center)  # -> Geometry, Transform; disabled
curvepoint = PointOnCurve(rotate.Geometry, parameter=1)  # disabled
number_slider_25 = Slider(0.99606201, range=0..1)  # disabled
button = Button()  # disabled
trigger = Trigger(Interval=1, TimerInterval=5, Target=c_script)  # disabled
mplane_2 = MeshPlane(Boundary=rectangle_2.Rectangle, WidthCount=number_slider_14, HeightCount=number_slider_14)  # -> Mesh, Area; disabled
number_slider_26 = Slider(0, range=0..10)  # disabled
number_slider_27 = Slider(1, range=0..1)  # disabled
data_4 = Data(pt)
divide = DivideCurve(Curve=crv, Count=division, Kinks=False)  # -> Points, Tangents, Parameters
move = Move(Motion=pt_2)  # -> Geometry, Transform; disabled
rectangle_4 = Rectangle(Plane=PlaneXY(0, 0, 0), XSize=number_slider_17, YSize=number_slider_17, Radius=0)  # -> Rectangle, Length
mplane_3 = MeshPlane(Boundary=rectangle_4.Rectangle, WidthCount=number_slider_5, HeightCount=number_slider_5)  # -> Mesh, Area
demesh = DeconstructMesh(Mesh=mplane_3.Mesh)  # -> Vertices, Faces, Colours, Normals
boxrec = BoxRectangle(Rectangle=rectangle_4.Rectangle, Height=Domain(0, 10))
number_slider_28 = Slider(1, range=0..1)  # disabled
mplane_4 = MeshPlane(Boundary=rectangle_3.Rectangle, WidthCount=number_slider_16, HeightCount=number_slider_16)  # -> Mesh, Area; disabled
xy_3 = XYPlane(Origin=Point(0, 0, 0))
move_2 = Move(Geometry=line, Motion=Vector(0, 0, 10))  # -> Geometry, Transform; disabled
c_script = CSharpScript(
    file=path,
    baseMesh=mplane.Mesh,
    bound=rectangle.Rectangle,
    strokeSize=Slider(6, range=0..100),
    threshold=Slider(0.5, range=0..1),
    edgeSegmentLength=number_slider_18,
    reset=button)  # -> out, A; inputs file: String, baseMesh: Mesh, bound: Rectangle3d, strokeSize: Double, threshold: Double, edgeSegmentLength: Double, reset: Boolean; disabled
# ---------- c_script: C# usings ----------
using System.Drawing;
using Grasshopper.Kernel.Geometry;
# ---------- c_script: C# ----------
    if (counter == 0){
      sourceImg = new Bitmap(file);
      rw = sourceImg.Width;
      rh = sourceImg.Height;

      iterImg = sourceImg.Clone(new Rectangle(0, 0, rw, rh), sourceImg.PixelFormat);
      canvas = Graphics.FromImage(iterImg);
      lines = new List<Line>();
      process = new Grasshopper.DataTree<Line>();
    }
    counter++;

    if(reset){
      counter = 0;
    }

    //Drawing setup - pen and shape
    pen = new Pen(Color.White, Convert.ToSingle(rw * strokeSize / bound.Width));
    pen.StartCap = System.Drawing.Drawing2D.LineCap.Round;
    pen.EndCap = System.Drawing.Drawing2D.LineCap.Round;

    //Skeletonize and draw on iterImg with skeleton trails
    lines.Clear();
    Extract(threshold, iterImg, baseMesh, bound, edgeSegmentLength, pen.Width, ref lines);
    canvas.Clear(Color.Black);

    foreach(Line l in lines){
      canvas.DrawLine(pen, Convert.ToInt32(rw * (l.From.X - bound.X.Min) / bound.Width), Convert.ToInt32(rh * (l.From.Y - bound.Y.Min) / bound.Height), Convert.ToInt32(rw * (l.To.X - bound.X.Min) / bound.Width), Convert.ToInt32(rh * (l.To.Y - bound.Y.Min) / bound.Height));
    }
    Print(counter.ToString());
    A = lines;
# ---------- c_script: C# additional code ----------
  Rhino.Geometry.Plane cutter = new Rhino.Geometry.Plane(new Point3d(0, 0, 0.5), new Vector3d(0, 0, 1));
  Bitmap sourceImg;
  Bitmap iterImg;
  Graphics canvas;
  int rw;
  int rh;
  List<Line> lines;
  Grasshopper.DataTree<Line> process;
  Pen pen;


  int counter = 0;
  public void Extract(double threshold0, Bitmap sourceImg0, Mesh baseMesh0, Rectangle3d r0, double edgeSegmentLength0, double maxSkeletonLength0, ref List<Line> result){
    double threshold = threshold0;
    Bitmap sourceImg = sourceImg0;
    Mesh baseMesh = baseMesh0;
    Rectangle3d r = r0;
    double edgeSegmentLength = edgeSegmentLength0;
    double maxSkeletonLength = maxSkeletonLength0;

    List<Point3d> extractedPoints = new List<Point3d>();
    Point3d[] rectCorners = r.BoundingBox.GetCorners();

    Polyline[] edges;
    for(int i = 0; i < baseMesh.Vertices.Count; i++){
      var pt = baseMesh.Vertices[i];
      Color rawColor = sourceImg.GetPixel(Convert.ToInt32((pt.X / r.Width) * (sourceImg.Width - 1)), Convert.ToInt32((pt.Y / r.Height) * (sourceImg.Height - 1)));
      baseMesh.Vertices.SetVertex(i, pt.X, pt.Y, rawColor.GetBrightness());
    }
    edges = Rhino.Geometry.Intersect.Intersection.MeshPlane(baseMesh, cutter);


    List<Node2> unit = new List<Node2>();
    Node2List nodes = new Node2List();

    for(int i = 0; i < edges.Length; i++){
      var edgesCrv = edges[i].ToPolylineCurve();
      for(int j = 0; j < (edgesCrv.Domain.Max - edgesCrv.Domain.Min) / edgeSegmentLength; j++){
        var tpt = edgesCrv.PointAt(j * edgeSegmentLength);
        unit.Add(new Node2(tpt.X, tpt.Y));
      }
    }

    foreach(Node2 a in unit){
      nodes.Append(a);
    }

    Node2List outline = new Node2List();
    foreach (Point3d p in rectCorners)
    {
      Node2 n = new Node2(p.X, p.Y);
      outline.Append(n);
    }

    var delaunay = Grasshopper.Kernel.Geometry.Delaunay.Solver.Solve_Connectivity(nodes, 0.1, false);
    var voronoi = Grasshopper.Kernel.Geometry.Voronoi.Solver.Solve_Connectivity(nodes, delaunay, outline);


    List<Line> centralLine = new  List<Line>();
    List<Double> vs = new  List<Double>();
    List<Double> ve = new  List<Double>();
    List<Point3d> ps = new  List<Point3d>();
    List<Point3d> pe = new  List<Point3d>();
    foreach( var c in voronoi)
    {
      Polyline pl = c.ToPolyline();
      var seg = pl.GetSegments();

      foreach( Line l in seg){
        var pStart = sourceImg.GetPixel(Convert.ToInt32((l.From.X / r.Width) * (sourceImg.Width - 1)), Convert.ToInt32((l.From.Y / r.Height) * (sourceImg.Height - 1)));
        var pEnd = sourceImg.GetPixel(Convert.ToInt32((l.To.X / r.Width) * (sourceImg.Width - 1)), Convert.ToInt32((l.To.Y / r.Height) * (sourceImg.Height - 1)));
        var pMid = sourceImg.GetPixel(Convert.ToInt32((0.5 * (l.From.X + l.To.X) / r.Width) * (sourceImg.Width - 1)), Convert.ToInt32((0.5 * (l.From.Y + l.To.Y) / r.Height) * (sourceImg.Height - 1)));

        if(pStart.GetBrightness() >= threshold && pMid.GetBrightness() >= threshold && pEnd.GetBrightness() >= threshold && l.Length < maxSkeletonLength){
          centralLine.Add(l);
        }
      }
    }
    result = centralLine;
  }
# ---------- end c_script ----------
panel = Panel(c_script.out)  # disabled
pt_3 = ConstructPoint(XCoordinate=Slider(0, range=-10..10), YCoordinate=Slider(0, range=-10..10), ZCoordinate=Slider(0, range=0..10))
scale = Scale(Center=data_3, Factor=number_slider_22)  # -> Geometry, Transform; disabled
scale_nu = ScaleNU(Geometry=center_3.Center, Plane=data_3, ScaleX=number_slider_19, ScaleY=number_slider_20, ScaleZ=number_slider_21)  # -> Geometry, Transform; disabled
pline_2 = PolyLine(Vertices=divide.Points, Closed=False)  # -> flatten(Polyline)
pipe = Pipe(Curve=pline_2, Radius=data, Caps=2)
Z = UnitZ(Factor=Slider(209, range=0..1000))
rotate_2 = Rotate(Angle=number_slider_12, Plane=data_3)  # -> Geometry, Transform; disabled
center_5 = Center(Geometric=rectangle_4.Rectangle)  # -> Center, Dimension
orient_2 = Orient(Geometry=textc_2, Source=center_2.Center, Target=center_5.Center)  # -> Geometry, Transform; disabled
cpoly_2 = ControlPolygon(Curve=orient_2.Geometry)  # -> Polygon, Points; disabled
pline_3 = PolyLine(Vertices=cpoly_2.Points, Closed=False)  # disabled
explode_2 = Explode(Curve=pline_3, Recursive=True)  # -> Segments, Vertices; disabled
data_5 = Data(flatten(explode_2.Segments))  # disabled
line_2 = Line(data_5)  # disabled
center_6 = Center(Geometric=line_2, forall=True)  # -> Center, Dimension; disabled
rotate_3 = Rotate(Geometry=line_2, Angle=number_slider_26, Plane=center_6.Center)  # -> Geometry, Transform; disabled
curvepoint_2 = PointOnCurve(rotate_3.Geometry, parameter=1)  # disabled
mplane_5 = MeshPlane(Boundary=rectangle_4.Rectangle, WidthCount=number_slider_23, HeightCount=number_slider_23)  # -> Mesh, Area
dom = ConstructDomain(DomainStart=number_slider_24, DomainEnd=number_slider_25)  # disabled
number_slider_29 = Slider(15, range=0..100)  # disabled
sunion = SolidUnion(Breps=flatten(pipe))
number_slider_30 = Slider(0.5, range=0..1)  # disabled
number_slider_31 = Slider(4, range=0..100)  # disabled
number_slider_32 = Slider(3, range=0..100)  # disabled
number_slider_33 = Slider(0.5, range=0..1)  # disabled
number_slider_34 = Slider(1000, range=0..1000)  # disabled
number_slider_35 = Slider(3, range=0..100)  # disabled
explode_3 = Explode(Curve=pline_2, Recursive=True)  # -> flatten(Segments), Vertices
button_2 = Button()  # disabled
center_7 = Center(Geometric=mplane.Mesh)  # -> Center, Dimension
path_2 = FilePath("C:\Users\RT-01\Desktop\Test.jpg")  # disabled
move_3 = Move(Geometry=center_7.Center, Motion=Z)  # -> Geometry, Transform
comp = Compound(Transforms=flatten([scale_nu.Transform, rotate_2.Transform, move.Transform]))  # disabled
data_6 = Data(c_script.A)  # disabled
path_3 = FilePath("C:\Users\Yufan\Desktop\TestImg.jpg")  # disabled
sint = SolidIntersection(BrepsA=sunion, BrepsB=boxrec)
brepinc = PointInBrep(Brep=sint, Point=demesh.Vertices, Strict=False)
Z_2 = UnitZ(Factor=brepinc)
mesh = MeshBrep(
    Brep=sint,
    Settings={GridMaxCount=0, GridMinCount=16, JaggedSeams=False, MaxEdgeLength=0, MinEdgeLength=0.0001, MinTolerance=0, Refine=True, RefineAngle=0, RelativeTolerance=0.65, SimplePlanes=True, Tolerance=0})
move_4 = Move(Geometry=demesh.Vertices, Motion=Z_2)  # -> Geometry, Transform
conmesh = ConstructMesh(Vertices=move_4.Geometry, Faces=demesh.Faces)
sec = MeshPlane(Mesh=mesh, Plane=xy_2)
sec_2 = MeshPlane(Mesh=conmesh, Plane=xy)
divlength = DivideLength(Curve=sec_2, Length=Slider(5, range=0..10))  # -> Points, Tangents, Parameters
voronoi = Voronoi(Points=flatten(divlength.Points), Boundary=rectangle_4.Rectangle, BruteForceOverride=False)
rint = RegionIntersection(CurvesA=sec, CurvesB=rectangle_4.Rectangle)
explode_4 = Explode(Curve=voronoi, Recursive=True)  # -> flatten(Segments), Vertices
end = EndPoints(Curve=explode_4.Segments)  # -> Start, End
boundary = BoundarySurfaces(Edges=rint)
len_2 = Length(Curve=explode_4.Segments)
remap = RemapNumbers(Value=number_slider_28, Source=Domain(0, 1), Target=dom)  # -> Mapped, Clipped; disabled
brepinc_2 = PointInBrep(Brep=sint, Point=end.Start, Strict=False)
brepinc_3 = PointInBrep(Brep=sint, Point=end.End, Strict=False)
group = Group(Objects=data_6)  # disabled
move_5 = Move(Motion=pt_3)  # -> Geometry, Transform
number_slider_36 = Slider(1, range=0..1)  # disabled
trigger_2 = Trigger(Interval=1, TimerInterval=5, Target=c_script_3)  # disabled
number_slider_37 = Slider(1, range=0..1)  # disabled
number_slider_38 = Slider(120, range=0..1000)
Y = UnitY(Factor=1)
scale_2 = Scale(Center=data_4, Factor=Slider(1, range=0.9..1.1))  # -> Geometry, Transform
scale_nu_2 = ScaleNU(
    Geometry=center_5.Center,
    Plane=data_4,
    ScaleX=Slider(1, range=0.9..1.1),
    ScaleY=Slider(1, range=0.9..1.1),
    ScaleZ=Slider(1, range=0.9..1.1))  # -> Geometry, Transform
move_6 = Move(Geometry=line_2, Motion=Vector(0, 0, 10))  # -> Geometry, Transform; disabled
smaller = SmallerThan(FirstNumber=len_2, SecondNumber=data)  # -> SmallerThan, OrEqualTo
and = GateAnd(A=brepinc_2, B=brepinc_3)
int = Integer(expr("X-1", number_slider_34))  # disabled
rotate_4 = Rotate(Angle=Slider(0, range=-0.1..0.1), Plane=data_4)  # -> Geometry, Transform
rec = DataRecorder(group, DataLimit=-10, RecordData=True)  # disabled
data_7 = Data(flatten(rec))  # disabled
lng = ListLength(List=data_7)  # -> expr("X-1", Length); disabled
neg = Negative(Value=Y)
srfsplit = SurfaceSplit(Surface=rectangle_4.Rectangle, Curves=sec_2)
data_8 = Data(sec_2)
c_script_2 = CSharpScript(
    file=path_2,
    baseMesh=mplane_2.Mesh,
    bound=rectangle_2.Rectangle,
    strokeSize=number_slider_32,
    threshold=number_slider_33,
    edgeSegmentLength=number_slider_35,
    iter=number_slider_34)  # -> out, A; inputs file: String, baseMesh: Mesh, bound: Rectangle3d, strokeSize: Double, threshold: Double, edgeSegmentLength: Double, iter: Int32; disabled
# ---------- c_script_2: C# ----------
    Bitmap sourceImg = new Bitmap(file);
    var rw = sourceImg.Width;
    var rh = sourceImg.Height;

    Bitmap iterImg = sourceImg.Clone(new Rectangle(0, 0, rw, rh), sourceImg.PixelFormat);
    Graphics canvas = Graphics.FromImage(iterImg);
    List<Line> lines = new List<Line>();
    Grasshopper.DataTree<Line> process = new Grasshopper.DataTree<Line>();

    //Drawing setup - pen and shape
    Pen pen = new Pen(Color.White, Convert.ToSingle(rw * strokeSize / bound.Width));
    pen.StartCap = System.Drawing.Drawing2D.LineCap.Round;
    pen.EndCap = System.Drawing.Drawing2D.LineCap.Round;

    //Skeletonize and draw on iterImg with skeleton trails, and record skeleton result
    for(int i = 0; i < iter; i++){
      lines.Clear();
      Extract(threshold, iterImg, baseMesh, bound, edgeSegmentLength, pen.Width, ref lines);
      canvas.Clear(Color.Black);

      foreach(Line l in lines){
        canvas.DrawLine(pen, Convert.ToInt32(rw * (l.From.X - bound.X.Min) / bound.Width), Convert.ToInt32(rh * (l.From.Y - bound.Y.Min) / bound.Height), Convert.ToInt32(rw * (l.To.X - bound.X.Min) / bound.Width), Convert.ToInt32(rh * (l.To.Y - bound.Y.Min) / bound.Height));
        Print("a");
      }
      process.AddRange(lines, new Grasshopper.Kernel.Data.GH_Path(i));
    }
    A = process;
# ---------- c_script_2: C# additional code ----------
  Rhino.Geometry.Plane cutter = new Rhino.Geometry.Plane(new Point3d(0, 0, 0.5), new Vector3d(0, 0, 1));

  public void Extract(double threshold0, Bitmap sourceImg0, Mesh baseMesh0, Rectangle3d r0, double edgeSegmentLength0, double maxSkeletonLength0, ref List<Line> result){
    double threshold = threshold0;
    Bitmap sourceImg = sourceImg0;
    Mesh baseMesh = baseMesh0;
    Rectangle3d r = r0;
    double edgeSegmentLength = edgeSegmentLength0;
    double maxSkeletonLength = maxSkeletonLength0;

    List<Point3d> extractedPoints = new List<Point3d>();
    Point3d[] rectCorners = r.BoundingBox.GetCorners();

    Polyline[] edges;
    for(int i = 0; i < baseMesh.Vertices.Count; i++){
      var pt = baseMesh.Vertices[i];
      Color rawColor = sourceImg.GetPixel(Convert.ToInt32((pt.X / r.Width) * (sourceImg.Width - 1)), Convert.ToInt32((pt.Y / r.Height) * (sourceImg.Height - 1)));
      baseMesh.Vertices.SetVertex(i, pt.X, pt.Y, rawColor.GetBrightness());
    }
    edges = Rhino.Geometry.Intersect.Intersection.MeshPlane(baseMesh, cutter);


    List<Node2> unit = new List<Node2>();
    Node2List nodes = new Node2List();

    for(int i = 0; i < edges.Length; i++){
      var edgesCrv = edges[i].ToPolylineCurve();
      for(int j = 0; j < (edgesCrv.Domain.Max - edgesCrv.Domain.Min) / edgeSegmentLength; j++){
        var tpt = edgesCrv.PointAt(j * edgeSegmentLength);
        unit.Add(new Node2(tpt.X, tpt.Y));
      }
    }

    foreach(Node2 a in unit){
      nodes.Append(a);
    }

    Node2List outline = new Node2List();
    foreach (Point3d p in rectCorners)
    {
      Node2 n = new Node2(p.X, p.Y);
      outline.Append(n);
    }

    var delaunay = Grasshopper.Kernel.Geometry.Delaunay.Solver.Solve_Connectivity(nodes, 0.1, false);
    var voronoi = Grasshopper.Kernel.Geometry.Voronoi.Solver.Solve_Connectivity(nodes, delaunay, outline);


    List<Line> centralLine = new  List<Line>();
    List<Double> vs = new  List<Double>();
    List<Double> ve = new  List<Double>();
    List<Point3d> ps = new  List<Point3d>();
    List<Point3d> pe = new  List<Point3d>();
    foreach( var c in voronoi)
    {
      Polyline pl = c.ToPolyline();
      var seg = pl.GetSegments();

      foreach( Line l in seg){
        var pStart = sourceImg.GetPixel(Convert.ToInt32((l.From.X / r.Width) * (sourceImg.Width - 1)), Convert.ToInt32((l.From.Y / r.Height) * (sourceImg.Height - 1)));
        var pEnd = sourceImg.GetPixel(Convert.ToInt32((l.To.X / r.Width) * (sourceImg.Width - 1)), Convert.ToInt32((l.To.Y / r.Height) * (sourceImg.Height - 1)));
        var pMid = sourceImg.GetPixel(Convert.ToInt32((0.5 * (l.From.X + l.To.X) / r.Width) * (sourceImg.Width - 1)), Convert.ToInt32((0.5 * (l.From.Y + l.To.Y) / r.Height) * (sourceImg.Height - 1)));

        if(pStart.GetBrightness() >= threshold && pMid.GetBrightness() >= threshold && pEnd.GetBrightness() >= threshold && l.Length < maxSkeletonLength){
          centralLine.Add(l);
        }
      }
    }
    result = centralLine;
  }
# ---------- end c_script_2 ----------
c_script_3 = CSharpScript(
    file=path_3,
    baseMesh=mplane_4.Mesh,
    bound=rectangle_3.Rectangle,
    strokeSize=number_slider_29,
    threshold=number_slider_30,
    edgeSegmentLength=number_slider_31,
    transform=comp,
    constantFeed=rotate.Geometry,
    reset=button_2)  # -> out, A; inputs file: String, baseMesh: Mesh, bound: Rectangle3d, strokeSize: Double, threshold: Double, edgeSegmentLength: Double, transform: Transform, constantFeed: list of Line, reset: Boolean; disabled
# ---------- c_script_3: C# ----------
    if (counter == 0){
      sourceImg = new Bitmap(file);
      rw = sourceImg.Width;
      rh = sourceImg.Height;

      iterImg = sourceImg.Clone(new Rectangle(0, 0, rw, rh), sourceImg.PixelFormat);
      canvas = Graphics.FromImage(iterImg);
      lines = new List<Line>();
      process = new Grasshopper.DataTree<Line>();
    }
    counter++;

    if(reset){
      counter = 0;
    }

    //Drawing setup - pen and shape
    pen = new Pen(Color.White, Convert.ToSingle(rw * strokeSize / bound.Width));
    pen.StartCap = System.Drawing.Drawing2D.LineCap.Round;
    pen.EndCap = System.Drawing.Drawing2D.LineCap.Round;

    //Skeletonize and draw on iterImg with skeleton trails
    lines.Clear();
    try{
      Extract(threshold, iterImg, baseMesh, bound, edgeSegmentLength, strokeSize, ref lines);
      canvas.Clear(Color.Black);

      foreach(Line l in lines){
        l.Transform(transform);
        canvas.DrawLine(pen, Convert.ToInt32(rw * (l.From.X - bound.X.Min) / bound.Width), Convert.ToInt32(rh * (l.From.Y - bound.Y.Min) / bound.Height), Convert.ToInt32(rw * (l.To.X - bound.X.Min) / bound.Width), Convert.ToInt32(rh * (l.To.Y - bound.Y.Min) / bound.Height));
      }
    }
    catch(Exception exMsg){
      Print(exMsg.Message);
      counter = 0;
    }

    foreach(Line l in constantFeed){
      canvas.DrawLine(pen, Convert.ToInt32(rw * (l.From.X - bound.X.Min) / bound.Width), Convert.ToInt32(rh * (l.From.Y - bound.Y.Min) / bound.Height), Convert.ToInt32(rw * (l.To.X - bound.X.Min) / bound.Width), Convert.ToInt32(rh * (l.To.Y - bound.Y.Min) / bound.Height));
    }
    Print(counter.ToString());
    A = lines;
# ---------- c_script_3: C# additional code ----------
  Rhino.Geometry.Plane cutter = new Rhino.Geometry.Plane(new Point3d(0, 0, 0.5), new Vector3d(0, 0, 1));
  Bitmap sourceImg;
  Bitmap iterImg;
  Graphics canvas;
  int rw;
  int rh;
  List<Line> lines;
  Grasshopper.DataTree<Line> process;
  Pen pen;


  int counter = 0;
  public void Extract(double threshold0, Bitmap sourceImg0, Mesh baseMesh0, Rectangle3d r0, double edgeSegmentLength0, double maxSkeletonLength0, ref List<Line> result){
    double threshold = threshold0;
    Bitmap sourceImg = sourceImg0;
    Mesh baseMesh = baseMesh0;
    Rectangle3d r = r0;
    double edgeSegmentLength = edgeSegmentLength0;
    double maxSkeletonLength = maxSkeletonLength0;

    List<Point3d> extractedPoints = new List<Point3d>();
    Point3d[] rectCorners = r.BoundingBox.GetCorners();

    Polyline[] edges;
    for(int i = 0; i < baseMesh.Vertices.Count; i++){
      var pt = baseMesh.Vertices[i];
      Color rawColor = sourceImg.GetPixel(Math.Min(Convert.ToInt32((pt.X / r.Width) * sourceImg.Width), sourceImg.Width - 1), Math.Min(Convert.ToInt32((pt.Y / r.Height) * sourceImg.Height), sourceImg.Height - 1));
      baseMesh.Vertices.SetVertex(i, pt.X, pt.Y, rawColor.GetBrightness());
    }
    edges = Rhino.Geometry.Intersect.Intersection.MeshPlane(baseMesh, cutter);


    List<Node2> unit = new List<Node2>();
    Node2List nodes = new Node2List();

    for(int i = 0; i < edges.Length; i++){
      var edgesCrv = edges[i].ToPolylineCurve();
      for(int j = 0; j < (edgesCrv.Domain.Max - edgesCrv.Domain.Min) / edgeSegmentLength; j++){
        var tpt = edgesCrv.PointAt(j * edgeSegmentLength);
        unit.Add(new Node2(tpt.X, tpt.Y));
      }
    }

    foreach(Node2 a in unit){
      nodes.Append(a);
    }

    Node2List outline = new Node2List();
    foreach (Point3d p in rectCorners)
    {
      Node2 n = new Node2(p.X, p.Y);
      outline.Append(n);
    }

    var delaunay = Grasshopper.Kernel.Geometry.Delaunay.Solver.Solve_Connectivity(nodes, 0.1, false);
    var voronoi = Grasshopper.Kernel.Geometry.Voronoi.Solver.Solve_Connectivity(nodes, delaunay, outline);


    List<Line> centralLine = new  List<Line>();
    List<Double> vs = new  List<Double>();
    List<Double> ve = new  List<Double>();
    List<Point3d> ps = new  List<Point3d>();
    List<Point3d> pe = new  List<Point3d>();
    foreach( var c in voronoi)
    {
      Polyline pl = c.ToPolyline();
      var seg = pl.GetSegments();

      foreach( Line l in seg){
        var pStart = sourceImg.GetPixel(Convert.ToInt32((l.From.X / r.Width) * (sourceImg.Width - 1)), Convert.ToInt32((l.From.Y / r.Height) * (sourceImg.Height - 1)));
        var pEnd = sourceImg.GetPixel(Convert.ToInt32((l.To.X / r.Width) * (sourceImg.Width - 1)), Convert.ToInt32((l.To.Y / r.Height) * (sourceImg.Height - 1)));
        var pMid = sourceImg.GetPixel(Convert.ToInt32((0.5 * (l.From.X + l.To.X) / r.Width) * (sourceImg.Width - 1)), Convert.ToInt32((0.5 * (l.From.Y + l.To.Y) / r.Height) * (sourceImg.Height - 1)));

        if(pStart.GetBrightness() >= threshold && pMid.GetBrightness() >= threshold && pEnd.GetBrightness() >= threshold && l.Length < maxSkeletonLength){
          centralLine.Add(l);
        }
      }
    }
    result = centralLine;
  }
# ---------- end c_script_3 ----------
panel_2 = Panel(c_script_3.out)  # disabled
multiplication = Multiplication(A=int, B=number_slider_36)  # disabled
and_2 = GateAnd(A=smaller.SmallerThan, B=and)
Z_3 = UnitZ(Factor=expr("-x", Slider(91, range=0..100)))
explode_5 = Explode(Curve=rectangle_4.Rectangle, Recursive=True)  # -> Segments, Vertices
multiplication_2 = Multiplication(A=lng, B=number_slider_37)  # disabled
comp_2 = Compound(Transforms=flatten([scale_nu_2.Transform, rotate_4.Transform, move_5.Transform]))
center_8 = Center(Geometric=rectangle_4.Rectangle)  # -> Center, Dimension
camera = CameraCrane(Location=move_3.Geometry, Target=center_7.Center, UPVector=neg, View=0, Refresh=True)  # -> Camera, Target, Lens, Up, HorizontalViewAngle, VerticalViewAngle, ScreenRatio, Frame
item_3 = ListItem(List=srfsplit, Index=0, Wrap=True)
cull = CullPattern(List=explode_4.Segments, CullPattern=and_2)
pipe_2 = Pipe(Curve=cull, Radius=data, Caps=2)
mesh_2 = MeshBrep(
    Brep=pipe_2,
    Settings={GridMaxCount=0, GridMinCount=16, JaggedSeams=False, MaxEdgeLength=0, MinEdgeLength=0.0001, MinTolerance=0, Refine=True, RefineAngle=0, RelativeTolerance=0.65, SimplePlanes=True, Tolerance=0})
sec_3 = MeshPlane(Mesh=mesh_2, Plane=xy_3)
runion = RegionUnion(Curves=flatten(sec_3))
rint_2 = RegionIntersection(CurvesA=runion, CurvesB=rectangle_4.Rectangle)
boundary_2 = BoundarySurfaces(Edges=rint_2)
mesh_3 = MeshBrep(
    Brep=boundary_2,
    Settings={GridMaxCount=0, GridMinCount=16, JaggedSeams=False, MaxEdgeLength=0, MinEdgeLength=0.0001, MinTolerance=0, Refine=True, RefineAngle=0, RelativeTolerance=0.65, SimplePlanes=True, Tolerance=0})
data_9 = Data(pline_2)
data_10 = Data(sint)
item_4 = ListItem(List=data_7, Index=multiplication_2, Wrap=True)  # disabled
data_11 = Data(boundary_2)
number_slider_39 = Slider(0.4016, range=0..1)  # disabled
number_slider_40 = Slider(16, range=0..100)
data_12 = Data(item_3)
move_7 = Move(Geometry=mesh_3, Motion=Z_3)  # -> Geometry, Transform
data_13 = Data(c_script_3.A)  # disabled
scale_3 = Scale(Geometry=explode_5.Segments, Center=center_8.Center, Factor=Slider(0.966, range=0..1))  # -> Geometry, Transform
group_2 = Group(Objects=data_13)  # disabled
branch = TreeBranch(Tree=simplify(c_script_2.A), Path=multiplication, MaintainPaths=True)  # disabled
number_slider_41 = Slider(0.48553, range=0..1)  # disabled
number_slider_42 = Slider(0.5267236, range=0..1)  # disabled
ungroup = Ungroup(Group=item_4)  # disabled
neg_2 = Negative(Value=number_slider_39)  # disabled
number_slider_43 = Slider(7, range=0..10)  # disabled
multiplication_3 = Multiplication(A=number_slider_38, B=Slider(1, range=0..10))
data_14 = Data(cull)
rec_2 = DataRecorder(group_2, DataLimit=-10, RecordData=True)  # disabled
data_15 = Data(flatten(rec_2))  # disabled
lng_2 = ListLength(List=data_15)  # -> expr("X-1", Length); disabled
multiplication_4 = Multiplication(A=lng_2, B=remap.Mapped)  # disabled
item_5 = ListItem(List=data_15, Index=multiplication_4, Wrap=True)  # disabled
ungroup_2 = Ungroup(Group=item_5)  # disabled
trigger_3 = Trigger(Interval=1, TimerInterval=5, Target=c_script_4)  # disabled
path_4 = FilePath("D:\XYF\PROJECT_PERSONAL\SkeletonBasedPhysarumSystem\20211201_CSystem\Mask_B_Rect1.png")
X = UnitX(Factor=multiplication_3)
multiplication_5 = Multiplication(A=number_slider_38, B=Slider(4, range=0..10))
addition = Addition(A=multiplication_5, B=Slider(120, range=0..1000), C=number_slider_38)
X_2 = UnitX(Factor=addition)
addition_2 = Addition(A=multiplication_5, B=Slider(120, range=0..1000))
addition_3 = Addition(A=X_2)
X_3 = UnitX(Factor=addition_2)
move_8 = Move(Geometry=data_12, Motion=X_3)  # -> Geometry, Transform
move_9 = Move(Geometry=data_11, Motion=X_3)  # -> Geometry, Transform
swatch = ColourSwatch(SwatchColor=RGB(0, 0, 0))
number_slider_44 = Slider(1, range=0..10)  # disabled
toggle = BooleanToggle(True)
swatch_2 = ColourSwatch(SwatchColor=RGB(0, 0, 0))  # disabled
multiplication_6 = Multiplication(A=number_slider_38, B=Slider(3, range=0..10))
offset = OffsetCurve(Curve=branch, Distance=number_slider_39, Corners=1)  # disabled
offset_2 = OffsetCurve(Curve=branch, Distance=neg_2, Corners=1)  # disabled
number_slider_45 = Slider(2, range=0..10)  # disabled
move_10 = Move(Geometry=data_10, Motion=X)  # -> Geometry, Transform
swatch_3 = ColourSwatch(SwatchColor=RGB(0, 0, 0))
swatch_4 = ColourSwatch(SwatchColor=RGB(0, 0, 0))  # disabled
data_16 = Data(voronoi)
number_slider_46 = Slider(0.4016, range=0..1)  # disabled
move_11 = Move(Geometry=data_8, Motion=X)  # -> Geometry, Transform
divlength_2 = DivideLength(Curve=ungroup_2, Length=number_slider_41)  # -> Points, Tangents, Parameters; disabled
path_5 = FilePath("D:\XYF\PROJECT_PERSONAL\SkeletonBasedPhysarumSystem\20211201_CSystem\PureWhite.png")
move_12 = Move(Geometry=cull, Motion=addition_3)  # -> Geometry, Transform
rdiff = RegionDifference(CurvesA=move_9.Geometry, CurvesB=move_8.Geometry)
move_13 = Move(Geometry=explode_3.Segments, Motion=addition_3)  # -> Geometry, Transform
bbox = BoundingBox(Content=move_13.Geometry, Plane=PlaneXY(0, 0, 0), UnionBox=True)  # -> Box, Box_2
rec_3 = Rectangle(bbox.Box)
X_4 = UnitX(Factor=multiplication_6)
material = CreateMaterial(Diffuse=swatch, Specular=RGB(255, 255, 255), Emission=swatch, Transparency=0, Shine=0)
number_slider_47 = Slider(0.4016, range=0..1)  # disabled
swatch_5 = ColourSwatch(SwatchColor=RGB(255, 255, 255))
Z_4 = UnitZ(Factor=expr("-x", Slider(91, range=0..100)))
number_slider_48 = Slider(0.5, range=0..10)
number_slider_49 = Slider(3, range=0..10)
mesh_4 = MeshBrep(
    Brep=move_8.Geometry,
    Settings={GridMaxCount=0, GridMinCount=16, JaggedSeams=False, MaxEdgeLength=0, MinEdgeLength=0.0001, MinTolerance=0, Refine=True, RefineAngle=0, RelativeTolerance=0.65, SimplePlanes=True, Tolerance=0})
mesh_5 = MeshBrep(
    Brep=move_9.Geometry,
    Settings={GridMaxCount=0, GridMinCount=16, JaggedSeams=False, MaxEdgeLength=0, MinEdgeLength=0.0001, MinTolerance=0, Refine=True, RefineAngle=0, RelativeTolerance=0.65, SimplePlanes=True, Tolerance=0})
bbox_2 = BoundingBox(Content=mesh_5, Plane=PlaneXY(0, 0, 0), UnionBox=True)  # -> Box, Box_2
rec_4 = Rectangle(bbox_2.Box)
neg_3 = Negative(Value=number_slider_46)  # disabled
multiplication_7 = Multiplication(A=number_slider_38, B=Slider(2, range=0..10))
center_9 = Center(Geometric=rectangle_4.Rectangle)  # -> Center, Dimension
mesh_6 = MeshBrep(
    Brep=move_10.Geometry,
    Settings={GridMaxCount=0, GridMinCount=16, JaggedSeams=False, MaxEdgeLength=0, MinEdgeLength=0.0001, MinTolerance=0, Refine=True, RefineAngle=0, RelativeTolerance=0.65, SimplePlanes=True, Tolerance=0})
move_14 = Move(Geometry=data_14, Motion=X_4)  # -> Geometry, Transform
bbox_3 = BoundingBox(Content=move_14.Geometry, Plane=PlaneXY(0, 0, 0), UnionBox=True)  # -> Box, Box_2
rec_5 = Rectangle(bbox_3.Box)
number_slider_50 = Slider(0.584, range=0..1)  # disabled
boundary_3 = BoundarySurfaces(Edges=rdiff)
neg_4 = Negative(Value=number_slider_47)  # disabled
rdiff_2 = RegionDifference(CurvesA=move_8.Geometry, CurvesB=move_9.Geometry)
X_5 = UnitX(Factor=multiplication_5)
previewlw = CustomPreviewLineweights(Geometry=[offset, offset_2], Shader=swatch_2, Thickness=number_slider_44, Absolute=False)  # disabled
X_6 = UnitX(Factor=multiplication_7)
c_script_4 = CSharpScript(
    file=path_5,
    baseMesh=mplane_5.Mesh,
    bound=rectangle_4.Rectangle,
    strokeSize=number_slider_40,
    threshold=Slider(0.5, range=0..1),
    edgeSegmentLength=Slider(12, range=0..100),
    transform=comp_2,
    constantFeed=explode_3.Segments,
    reset=Button())  # -> out, B, A; inputs file: String, baseMesh: Mesh, bound: Rectangle3d, strokeSize: Double, threshold: Double, edgeSegmentLength: Double, transform: Transform, constantFeed: list of Line, environmentImage: String, reset: Boolean
# ---------- c_script_4: C# ----------
    if (counter == 0){
      sourceImg = new Bitmap(file);
      rw = sourceImg.Width;
      rh = sourceImg.Height;

      iterImg = sourceImg.Clone(new Rectangle(0, 0, rw, rh), System.Drawing.Imaging.PixelFormat.Format32bppPArgb);
      canvas = Graphics.FromImage(iterImg);
      lines = new List<Line>();
      voronoiUnits = new List<Polyline>();
      process = new Grasshopper.DataTree<Line>();
      Polyline[] midEdges;
    }
    counter++;

    if(reset){
      counter = 0;
    }

    //Drawing setup - pen and shape
    pen = new Pen(Color.White, Convert.ToSingle(rw * strokeSize / bound.Width));
    pen.StartCap = System.Drawing.Drawing2D.LineCap.Round;
    pen.EndCap = System.Drawing.Drawing2D.LineCap.Round;

    //Skeletonize and draw on iterImg with skeleton trails
    lines.Clear();
    try{
      Extract(threshold, iterImg, baseMesh, bound, edgeSegmentLength, strokeSize, ref lines, ref voronoiUnits, ref midEdges);
      canvas.Clear(Color.Black);

      foreach(Line l in lines){
        l.Transform(transform);
        canvas.DrawLine(pen, Convert.ToInt32(rw * (l.From.X - bound.X.Min) / bound.Width), Convert.ToInt32(rh * (l.From.Y - bound.Y.Min) / bound.Height), Convert.ToInt32(rw * (l.To.X - bound.X.Min) / bound.Width), Convert.ToInt32(rh * (l.To.Y - bound.Y.Min) / bound.Height));
      }
    }
    catch(Exception exMsg){
      Print(exMsg.Message);
      counter = 0;
    }

    foreach(Line l in constantFeed){
      canvas.DrawLine(pen, Convert.ToInt32(rw * (l.From.X - bound.X.Min) / bound.Width), Convert.ToInt32(rh * (l.From.Y - bound.Y.Min) / bound.Height), Convert.ToInt32(rw * (l.To.X - bound.X.Min) / bound.Width), Convert.ToInt32(rh * (l.To.Y - bound.Y.Min) / bound.Height));
    }

    //Overlay environment image
    try{
      canvas.DrawImage(environmentImg, new Rectangle(0, 0, rw, rh));
      environmentImg = new Bitmap(environmentImage);
    }
    catch(Exception exMsg){
      Print(exMsg.Message);
    }

    Print(counter.ToString());
    A = lines;
    B = voronoiUnits;
# ---------- c_script_4: C# additional code ----------
  Rhino.Geometry.Plane cutter = new Rhino.Geometry.Plane(new Point3d(0, 0, 0.5), new Vector3d(0, 0, 1));
  Bitmap sourceImg;
  Bitmap iterImg;
  Bitmap environmentImg;
  Graphics canvas;
  int rw;
  int rh;
  List<Line> lines;
  List<Polyline> voronoiUnits;
  Polyline[] midEdges;
  Grasshopper.DataTree<Line> process;
  Pen pen;


  int counter = 0;
  public void Extract(double threshold0, Bitmap sourceImg0, Mesh baseMesh0, Rectangle3d r0, double edgeSegmentLength0, double maxSkeletonLength0, ref List<Line> result, ref List<Polyline> vo, ref Polyline[] midEdge){
    double threshold = threshold0;
    Bitmap sourceImg = sourceImg0;
    Mesh baseMesh = baseMesh0;
    Rectangle3d r = r0;
    double edgeSegmentLength = edgeSegmentLength0;
    double maxSkeletonLength = maxSkeletonLength0;

    List<Point3d> extractedPoints = new List<Point3d>();
    Point3d[] rectCorners = r.BoundingBox.GetCorners();

    Polyline[] edges;
    for(int i = 0; i < baseMesh.Vertices.Count; i++){
      var pt = baseMesh.Vertices[i];
      Color rawColor = sourceImg.GetPixel(Math.Min(Convert.ToInt32((pt.X / r.Width) * sourceImg.Width), sourceImg.Width - 1), Math.Min(Convert.ToInt32((pt.Y / r.Height) * sourceImg.Height), sourceImg.Height - 1));
      baseMesh.Vertices.SetVertex(i, pt.X, pt.Y, rawColor.GetBrightness());
    }
    edges = Rhino.Geometry.Intersect.Intersection.MeshPlane(baseMesh, cutter);


    List<Node2> unit = new List<Node2>();
    Node2List nodes = new Node2List();

    for(int i = 0; i < edges.Length; i++){
      var edgesCrv = edges[i].ToPolylineCurve();
      for(int j = 0; j < (edgesCrv.Domain.Max - edgesCrv.Domain.Min) / edgeSegmentLength; j++){
        var tpt = edgesCrv.PointAt(j * edgeSegmentLength);
        unit.Add(new Node2(tpt.X, tpt.Y));
      }
    }

    foreach(Node2 a in unit){
      nodes.Append(a);
    }

    Node2List outline = new Node2List();
    foreach (Point3d p in rectCorners)
    {
      Node2 n = new Node2(p.X, p.Y);
      outline.Append(n);
    }

    var delaunay = Grasshopper.Kernel.Geometry.Delaunay.Solver.Solve_Connectivity(nodes, 0.1, false);
    var voronoi = Grasshopper.Kernel.Geometry.Voronoi.Solver.Solve_Connectivity(nodes, delaunay, outline);


    List<Line> centralLine = new  List<Line>();
    List<Polyline> rawVo = new  List<Polyline>();
    List<Double> vs = new  List<Double>();
    List<Double> ve = new  List<Double>();
    List<Point3d> ps = new  List<Point3d>();
    List<Point3d> pe = new  List<Point3d>();
    foreach( var c in voronoi)
    {
      Polyline pl = c.ToPolyline();
      var seg = pl.GetSegments();
      rawVo.Add(pl);

      foreach( Line l in seg){
        var pStart = sourceImg.GetPixel(Convert.ToInt32((l.From.X / r.Width) * (sourceImg.Width - 1)), Convert.ToInt32((l.From.Y / r.Height) * (sourceImg.Height - 1)));
        var pEnd = sourceImg.GetPixel(Convert.ToInt32((l.To.X / r.Width) * (sourceImg.Width - 1)), Convert.ToInt32((l.To.Y / r.Height) * (sourceImg.Height - 1)));
        var pMid = sourceImg.GetPixel(Convert.ToInt32((0.5 * (l.From.X + l.To.X) / r.Width) * (sourceImg.Width - 1)), Convert.ToInt32((0.5 * (l.From.Y + l.To.Y) / r.Height) * (sourceImg.Height - 1)));


        if(pStart.GetBrightness() >= threshold && pMid.GetBrightness() >= threshold && pEnd.GetBrightness() >= threshold && l.Length < maxSkeletonLength){
          centralLine.Add(l);
        }
      }
    }
    result = centralLine;
    vo = rawVo;
    midEdge = edges;
  }
# ---------- end c_script_4 ----------
swatch_6 = ColourSwatch(SwatchColor=RGB(0, 0, 0))  # disabled
move_15 = Move(Geometry=mesh_6, Motion=Z_4)  # -> Geometry, Transform
bbox_4 = BoundingBox(Content=move_15.Geometry, Plane=PlaneXY(0, 0, 0), UnionBox=True)  # -> Box, Box_2
rec_6 = Rectangle(bbox_4.Box)
previewlw_2 = CustomPreviewLineweights(Geometry=ungroup, Shader=swatch_4, Thickness=number_slider_45, Absolute=False)  # disabled
emitter = PointEmitter(Emitter=divlength_2.Points, Radius=number_slider_42, Number=number_slider_43, Tendency=0.25)  # disabled
scale_4 = Scale(Geometry=rectangle_4.Rectangle, Center=center_9.Center, Factor=Slider(0.999, range=0..1))  # -> Geometry, Transform
offset_3 = OffsetCurve(Curve=ungroup_2, Distance=number_slider_46, Corners=1)  # disabled
offset_4 = OffsetCurve(Curve=ungroup_2, Distance=neg_3, Corners=1)  # disabled
swatch_7 = ColourSwatch(SwatchColor=RGB(0, 0, 0))
swatch_8 = ColourSwatch(SwatchColor=RGB(0, 0, 0))
boundary_4 = BoundarySurfaces(Edges=rdiff_2)
lng_3 = ListLength(List=c_script_2.A)  # disabled
move_16 = Move(Geometry=move_7.Geometry, Motion=X_5)  # -> Geometry, Transform
bbox_5 = BoundingBox(Content=move_16.Geometry, Plane=PlaneXY(0, 0, 0), UnionBox=True)  # -> Box, Box_2
rec_7 = Rectangle(bbox_5.Box)
lng_4 = ListLength(List=c_script_2.out)  # disabled
number_slider_51 = Slider(2, range=0..10)
panel_3 = Panel(c_script_2.out)  # disabled
move_17 = Move(Geometry=data_16, Motion=X_6)  # -> Geometry, Transform
offset_5 = OffsetCurve(Curve=ungroup, Distance=number_slider_47, Corners=1)  # disabled
panel_4 = Panel(c_script_2.A)  # disabled
offset_6 = OffsetCurve(Curve=ungroup, Distance=neg_4, Corners=1)  # disabled
number_slider_52 = Slider(2, range=0..10)
xy_4 = XYPlane(Origin=Point(0, 0, 0))
material_2 = CreateMaterial(
    Diffuse=ColourSwatch(SwatchColor=RGB(0, 0, 0)),
    Specular=RGB(255, 255, 255),
    Emission=ColourSwatch(SwatchColor=RGB(204, 204, 204)),
    Transparency=0,
    Shine=0)
panel_5 = Panel(c_script_4.out)
panel_6 = Panel(lng_3)  # disabled
panel_7 = Panel(lng_4)  # disabled
previewlw_3 = CustomPreviewLineweights(Geometry=rec_6, Shader=swatch_7, Thickness=number_slider_48, Absolute=toggle)
data_17 = Data(c_script_4.A)
previewlw_4 = CustomPreviewLineweights(Geometry=rec_7, Shader=swatch_7, Thickness=number_slider_48, Absolute=toggle)
previewlw_5 = CustomPreviewLineweights(Geometry=rec_4, Shader=swatch_7, Thickness=number_slider_48, Absolute=toggle)
previewlw_6 = CustomPreviewLineweights(Geometry=rec_5, Shader=swatch_7, Thickness=number_slider_48, Absolute=toggle)
previewlw_7 = CustomPreviewLineweights(Geometry=rec_3, Shader=swatch_7, Thickness=number_slider_48, Absolute=toggle)
previewlw_8 = CustomPreviewLineweights(
    Geometry=move_13.Geometry,
    Shader=ColourSwatch(SwatchColor=RGB(128, 128, 128)),
    Thickness=number_slider_49,
    Absolute=toggle)
previewlw_9 = CustomPreviewLineweights(Geometry=move_12.Geometry, Shader=ColourSwatch(SwatchColor=RGB(0, 0, 0)), Thickness=number_slider_49, Absolute=toggle)
trim = TrimWithRegion(Curve=data_17, Region=scale_4.Geometry, Plane=xy_4)  # -> Inside, Outside
symadv = SymbolAdvanced(
    Style=1,
    SizePrimary=number_slider_50,
    SizeSecondary=number_slider_50,
    Rotation=0,
    Fill=swatch_6,
    Edge=swatch_6,
    Width=2,
    Adjust=False)  # disabled
preview = CustomPreview(Geometry=scale_4.Geometry, Material=ColourSwatch(SwatchColor=RGB(0, 0, 0)))
data_18 = Data(c_script_4.B)
material_3 = CreateMaterial(Diffuse=swatch_8, Specular=RGB(255, 255, 255), Emission=swatch_8, Transparency=0, Shine=0)
material_4 = CreateMaterial(
    Diffuse=ColourSwatch(SwatchColor=RGB(0, 0, 0)),
    Specular=RGB(255, 255, 255),
    Emission=ColourSwatch(SwatchColor=RGB(204, 204, 204)),
    Transparency=0,
    Shine=0)
previewlw_10 = CustomPreviewLineweights(Geometry=move_11.Geometry, Shader=ColourSwatch(SwatchColor=RGB(0, 0, 0)), Thickness=number_slider_51, Absolute=toggle)
previewlw_11 = CustomPreviewLineweights(Geometry=trim.Inside, Shader=ColourSwatch(SwatchColor=RGB(0, 0, 0)), Thickness=number_slider_40, Absolute=False)
move_18 = Move(Geometry=move_15.Geometry, Motion=X)  # -> Geometry, Transform
symbol = SymbolDisplay(Location=emitter, Display=symadv)  # disabled
preview_2 = CustomPreview(Geometry=boundary_3, Material=material_3)
preview_3 = CustomPreview(Geometry=boundary_4, Material=material_3)
number_slider_53 = Slider(2, range=0..10)  # disabled
swatch_9 = ColourSwatch(SwatchColor=RGB(0, 0, 0))  # disabled
preview_4 = CustomPreview(Geometry=mesh_5, Material=material_4)
previewlw_12 = CustomPreviewLineweights(
    Geometry=[move_14.Geometry, data_9],
    Shader=ColourSwatch(SwatchColor=RGB(0, 0, 0)),
    Thickness=number_slider_49,
    Absolute=toggle)
preview_5 = CustomPreview(Geometry=mesh_4, Material=material_4)
number_slider_54 = Slider(0, range=0..1)  # disabled
number_slider_55 = Slider(1, range=0..1)  # disabled
capacitor = Capacitor(Data=data_17, Capacity=Slider(2, range=0..10))
preview_6 = CustomPreview(Geometry=move_18.Geometry, Material=material_2)
preview_7 = CustomPreview(Geometry=move_16.Geometry, Material=material_2)
number_slider_56 = Slider(1, range=0..1)  # disabled
preview_8 = CustomPreview(Geometry=move_15.Geometry, Material=material_2)
number_slider_57 = Slider(1, range=0..1)  # disabled
previewlw_13 = CustomPreviewLineweights(Geometry=ungroup_2, Shader=swatch_9, Thickness=number_slider_53, Absolute=False)  # disabled
previewlw_14 = CustomPreviewLineweights(Geometry=move_17.Geometry, Shader=ColourSwatch(SwatchColor=RGB(0, 0, 0)), Thickness=number_slider_51, Absolute=toggle)
dom_2 = ConstructDomain(DomainStart=number_slider_54, DomainEnd=number_slider_55)  # disabled
group_3 = Group(Objects=data_17)  # disabled
remap_2 = RemapNumbers(Value=number_slider_57, Source=Domain(0, 1), Target=dom_2)  # -> Mapped, Clipped; disabled
rec_8 = DataRecorder(group_3, DataLimit=-10, RecordData=True)  # disabled
data_19 = Data(flatten(rec_8))  # disabled
lng_5 = ListLength(List=data_19)  # -> expr("X-1", Length); disabled
multiplication_8 = Multiplication(A=lng_5, B=remap_2.Mapped)  # disabled
item_6 = ListItem(List=data_19, Index=multiplication_8, Wrap=True)  # disabled
number_slider_58 = Slider(0.48553, range=0..1)  # disabled
ungroup_3 = Ungroup(Group=item_6)  # disabled
number_slider_59 = Slider(0.5267236, range=0..1)  # disabled
number_slider_60 = Slider(6, range=0..10)  # disabled
number_slider_61 = Slider(2, range=0..10)  # disabled
swatch_10 = ColourSwatch(SwatchColor=RGB(0, 0, 0))  # disabled
divlength_3 = DivideLength(Curve=ungroup_3, Length=number_slider_58)  # -> Points, Tangents, Parameters; disabled
number_slider_62 = Slider(0.584, range=0..1)  # disabled
previewlw_15 = CustomPreviewLineweights(Geometry=ungroup_3, Shader=swatch_10, Thickness=number_slider_61, Absolute=False)  # disabled
swatch_11 = ColourSwatch(SwatchColor=RGB(0, 0, 0))  # disabled
emitter_2 = PointEmitter(Emitter=divlength_3.Points, Radius=number_slider_59, Number=number_slider_60, Tendency=0.25)  # disabled
symadv_2 = SymbolAdvanced(
    Style=1,
    SizePrimary=number_slider_62,
    SizeSecondary=number_slider_62,
    Rotation=0,
    Fill=swatch_11,
    Edge=swatch_11,
    Width=2,
    Adjust=False)  # disabled
symbol_2 = SymbolDisplay(Location=emitter_2, Display=symadv_2)  # disabled
