# Grasshopper definition Physarum_2022.gh (Grasshopper 1.0.7)
# plug-ins: Coral, Heteroptera, Human, Kangaroo2 Components

number_slider = Slider(0, range=0..10)
rectangle = Rectangle(Plane=PlaneXY(0, 0, 0), XSize=Slider(1280, range=0..10000), YSize=Slider(720, range=0..1000), Radius=0)  # -> Rectangle, Length
explode = Explode(Curve=rectangle.Rectangle, Recursive=True)  # -> Segments, Vertices
path = FilePath("D:\XYF\PROJECT_PERSONAL\SkeletonBasedPhysarumSystem\20211201_CSystem\WhiteDot.png")
Z = UnitZ(Factor=Slider(1505, range=0..10000))
X = UnitX(Factor=number_slider)
mplane = MeshPlane(Boundary=rectangle.Rectangle, WidthCount=Slider(256, range=0..1000), HeightCount=Slider(144, range=0..1000))  # -> Mesh, Area
center = Center(Geometric=mplane.Mesh)  # -> Center, Dimension
Y = UnitY(Factor=number_slider)
move = Move(Motion=Y)  # -> Geometry, Transform
center_2 = Center(Geometric=rectangle.Rectangle)  # -> Center, Dimension
move_2 = Move(Geometry=center_2.Center, Motion=Z)  # -> Geometry, Transform
scale = Scale(Center=center.Center, Factor=Slider(1, range=0..10))  # -> Geometry, Transform
scale_nu = ScaleNU(Plane=center.Center, ScaleX=1, ScaleY=Slider(1.01, range=0..10), ScaleZ=1)  # -> Geometry, Transform
mousedata = MouseData()
Y_2 = UnitY(Factor=1)
trigger = Trigger(Interval=1, TimerInterval=5, Target=nickname)  # disabled
neg = Negative(Value=Y_2)
path_2 = FilePath("D:\XYF\PROJECT_PERSONAL\SkeletonBasedPhysarumSystem\20211201_CSystem\2021.png")
path_3 = FilePath("D:\XYF\PROJECT_PERSONAL\SkeletonBasedPhysarumSystem\20211201_CSystem\2022.png")
transform = Transform(flatten(scale_nu.Transform))
number_slider_2 = Slider(8, range=0..10)
camera = CameraCrane(Location=move_2.Geometry, Target=center_2.Center, UPVector=neg, View=0, Refresh=True)  # -> Camera, Target, Lens, Up, HorizontalViewAngle, VerticalViewAngle, ScreenRatio, Frame
capacitor = Capacitor(Data=mousedata, Capacity=Slider(12, range=0..100))  # -> flatten(Data)
line = Line(capacitor)
yz = YZPlane(Origin=center_2.Center)
nickname = SkeletonPhysarum2D(
    ImageFile=path,
    Mesh=mplane.Mesh,
    Boundary=rectangle.Rectangle,
    ExpansionRadius=Slider(2, range=0..100),
    Threshold=0.5,
    EdgeDivisionLength=Slider(1, range=0..10),
    TransformX=transform,
    ConstantPixelFeed=path_3,
    Reset=Button())
group = Group(Objects=nickname)
rec = DataRecorder(DataLimit=-10, RecordData=True)
ungroup = Ungroup(Group=rec)
clean = CleanTree(RemoveNulls=True, RemoveInvalid=True, RemoveEmpty=False, Tree=ungroup)
lng = ListLength(List=clean)
equals = Equality(FirstNumber=0, SecondNumber=lng)  # -> Equality, Inequality
cull = CullPattern(List=rec, CullPattern=flatten(equals.Inequality))
data = Data(cull)
lng_2 = ListLength(List=data)  # -> expr("X-1", Length)
multiplication = Multiplication(A=lng_2, B=Slider(0.01481481, range=0..1))
item = ListItem(List=data, Index=multiplication, Wrap=True)
mirror = Mirror(Geometry=item, Plane=yz)  # -> Geometry, Transform
group_2 = Group(Objects=nickname)  # disabled
dupln = RemoveDuplicateLines(Lines=nickname, Tolerance=0.01)  # disabled
number_slider_3 = Slider(2, range=0..10)  # disabled
rec_2 = DataRecorder(group_2, DataLimit=-10, RecordData=True)  # disabled
join = JoinCurves(Curves=dupln, Preserve=False)  # disabled
swatch = ColourSwatch(SwatchColor=RGB(0, 0, 0))
ungroup_2 = Ungroup(Group=mirror.Geometry)
previewlw = CustomPreviewLineweights(Geometry=nickname, Shader=ColourSwatch(SwatchColor=RGB(0, 0, 0)), Thickness=Slider(6, range=0..10), Absolute=False)
end = EndPoints(Curve=ungroup_2)  # -> Start, End
curvepoint = PointOnCurve(ungroup_2, parameter=0.5)
dom = ConstructDomain(DomainStart=0, DomainEnd=1)
vec2pt = Vector2Pt(PointA=end.Start, PointB=end.End, Unitize=False)  # -> Vector, Length
pdecon = Deconstruct(Point=vec2pt.Vector)  # -> XComponent, YComponent, ZComponent
bnd = Bounds(Numbers=pdecon.XComponent)
bnd_2 = Bounds(Numbers=pdecon.ZComponent)
bnd_3 = Bounds(Numbers=pdecon.YComponent)
reb = RebuildCurve(Curve=join, Degree=number_slider_3, Count=10, Tangents=False)  # disabled
remap = RemapNumbers(Value=pdecon.XComponent, Source=bnd, Target=Domain(0, 1))  # -> Mapped, Clipped
remap_2 = RemapNumbers(Value=pdecon.ZComponent, Source=bnd_2, Target=Domain(0, 1))  # -> Mapped, Clipped
remap_3 = RemapNumbers(Value=pdecon.YComponent, Source=bnd_3, Target=Domain(0, 1))  # -> Mapped, Clipped
item_2 = ListItem(List=join, Index=Slider(41, range=0..100), Wrap=True)
frgb = ColourRGBF(Alpha=1, Red=remap.Mapped, Green=remap_3.Mapped, Blue=remap_2.Mapped)
previewlw_2 = CustomPreviewLineweights(Geometry=item_2, Shader=ColourSwatch(SwatchColor=RGB(0, 0, 0)), Thickness=Slider(6, range=0..10), Absolute=False)
dom_2 = ConstructDomain(DomainStart=Slider(0, range=0..10), DomainEnd=Slider(5.7792, range=0..10))
data_2 = Data(graft(frgb))
emitter = PointEmitter(Emitter=curvepoint, Radius=dom_2, Number=Slider(4, range=0..10), Tendency=0.25)
symadv = SymbolAdvanced(
    Style=4,
    SizePrimary=Slider(0.103, range=0..10),
    SizeSecondary=Slider(0, range=0..10),
    Rotation=0,
    Fill=data_2,
    Edge=data_2,
    Width=2,
    Adjust=True)
symbol = SymbolDisplay(Location=emitter, Display=symadv)
