# Grasshopper definition SkeletonPhysarum_BrushInfo.gh (Grasshopper 1.0.7)
# plug-ins: Heteroptera, Squid, Human, Slime

txt = Text(["A", "B", "C", "D", "E", "F", "G", "H", "I", "J", "K", "L", "M", "N", "O", "P", "Q", "R", "S", "T", "U", "V", "W", "X", "Y", "Z"])
font = Font(Family="Arial", Size=Slider(51, range=0..100), Bold=False, Italic=False, Underline=False)
item = ListItem(List=txt, Index=Slider(18, range=0..100), Wrap=True)
textc = TextCurves(Plane=PlaneXY(0, 0, 0), Text=item, Font=font)
center = Center(Geometric=textc, forall=True)  # -> Center, Dimension
number_slider = Slider(51, range=0..100)  # disabled
number_slider_2 = Slider(18, range=0..100)  # disabled
number_slider_3 = Slider(100, range=0..200)
txt_2 = Text(["A", "B", "C", "D", "E", "F", "G", "H", "I", "J", "K", "L", "M", "N", "O", "P", "Q", "R", "S", "T", "U", "V", "W", "X", "Y", "Z"])  # disabled
font_2 = Font(Family="Arial", Size=number_slider, Bold=False, Italic=False, Underline=False)  # disabled
pt = ConstructPoint(XCoordinate=0, YCoordinate=0, ZCoordinate=0)
item_2 = ListItem(List=txt_2, Index=number_slider_2, Wrap=True)  # disabled
number_slider_4 = Slider(240, range=0..1000)
textc_2 = TextCurves(Plane=PlaneXY(0, 0, 0), Text=item_2, Font=font_2)  # disabled
data = Data(pt)
rectangle = Rectangle(Plane=PlaneXY(0, 0, 0), XSize=number_slider_3, YSize=number_slider_3, Radius=0)  # -> Rectangle, Length
pt_2 = ConstructPoint(XCoordinate=Slider(0, range=-10..10), YCoordinate=Slider(0, range=-10..10), ZCoordinate=Slider(0, range=0..10))
center_2 = Center(Geometric=textc_2, forall=True)  # -> Center, Dimension; disabled
center_3 = Center(Geometric=rectangle.Rectangle)  # -> Center, Dimension
orient = Orient(Geometry=textc, Source=center.Center, Target=center_3.Center)  # -> Geometry, Transform
cpoly = ControlPolygon(Curve=orient.Geometry)  # -> Polygon, Points
pline = PolyLine(Vertices=cpoly.Points, Closed=False)
explode = Explode(Curve=pline, Recursive=True)  # -> Segments, Vertices
data_2 = Data(flatten(explode.Segments))
line = Line(data_2)
center_4 = Center(Geometric=line, forall=True)  # -> Center, Dimension
rotate = Rotate(Geometry=line, Angle=Slider(0, range=0..10), Plane=center_4.Center)  # -> Geometry, Transform
curvepoint = PointOnCurve(rotate.Geometry, parameter=1)
mplane = MeshPlane(Boundary=rectangle.Rectangle, WidthCount=number_slider_4, HeightCount=number_slider_4)  # -> Mesh, Area
move = Move(Motion=pt_2)  # -> Geometry, Transform
rotate_2 = Rotate(Angle=Slider(0, range=-0.1..0.1), Plane=data)  # -> Geometry, Transform
scale = Scale(Center=center_3.Center, Factor=Slider(1.001, range=0.9..1.1))  # -> Geometry, Transform
scale_nu = ScaleNU(
    Geometry=center_3.Center,
    Plane=data,
    ScaleX=Slider(1, range=0.9..1.1),
    ScaleY=Slider(1, range=0.9..1.1),
    ScaleZ=Slider(1, range=0.9..1.1))  # -> Geometry, Transform
move_2 = Move(Geometry=line, Motion=Vector(0, 0, 10))  # -> Geometry, Transform
explode_2 = Explode(Curve=rectangle.Rectangle, Recursive=True)  # -> Segments, Vertices
number_slider_5 = Slider(100, range=0..200)  # disabled
comp = Compound(Transforms=flatten(scale.Transform))
center_5 = Center(Geometric=rectangle.Rectangle)  # -> Center, Dimension
number_slider_6 = Slider(0, range=0..10)  # disabled
number_slider_7 = Slider(0, range=-10..10)  # disabled
number_slider_8 = Slider(0, range=-10..10)  # disabled
pt_3 = ConstructPoint(XCoordinate=0, YCoordinate=0, ZCoordinate=0)  # disabled
number_slider_9 = Slider(240, range=0..1000)  # disabled
number_slider_10 = Slider(0, range=-0.1..0.1)  # disabled
number_slider_11 = Slider(2, range=0..100)
scale_2 = Scale(Geometry=explode_2.Segments, Center=center_5.Center, Factor=Slider(0.966, range=0..1))  # -> Geometry, Transform
number_slider_12 = Slider(0, range=0..10)  # disabled
data_3 = Data(pt_3)  # disabled
rectangle_2 = Rectangle(Plane=PlaneXY(0, 0, 0), XSize=number_slider_5, YSize=number_slider_5, Radius=0)  # -> Rectangle, Length; disabled
pt_4 = ConstructPoint(XCoordinate=number_slider_7, YCoordinate=number_slider_8, ZCoordinate=number_slider_6)  # disabled
trigger = Trigger(Interval=1, TimerInterval=5, Target=c_script)  # disabled
center_6 = Center(Geometric=rectangle_2.Rectangle)  # -> Center, Dimension; disabled
orient_2 = Orient(Geometry=textc_2, Source=center_2.Center, Target=center_6.Center)  # -> Geometry, Transform; disabled
cpoly_2 = ControlPolygon(Curve=orient_2.Geometry)  # -> Polygon, Points; disabled
pline_2 = PolyLine(Vertices=cpoly_2.Points, Closed=False)  # disabled
explode_3 = Explode(Curve=pline_2, Recursive=True)  # -> Segments, Vertices; disabled
data_4 = Data(flatten(explode_3.Segments))  # disabled
line_2 = Line(data_4)  # disabled
center_7 = Center(Geometric=line_2, forall=True)  # -> Center, Dimension; disabled
rotate_3 = Rotate(Geometry=line_2, Angle=number_slider_12, Plane=center_7.Center)  # -> Geometry, Transform; disabled
curvepoint_2 = PointOnCurve(rotate_3.Geometry, parameter=1)  # disabled
number_slider_13 = Slider(1, range=0.9..1.1)  # disabled
number_slider_14 = Slider(1, range=0.9..1.1)  # disabled
number_slider_15 = Slider(1, range=0.9..1.1)  # disabled
number_slider_16 = Slider(1, range=0.9..1.1)  # disabled
mplane_2 = MeshPlane(Boundary=rectangle_2.Rectangle, WidthCount=number_slider_9, HeightCount=number_slider_9)  # -> Mesh, Area; disabled
path = FilePath("D:\XYF\PROJECT_PERSONAL\SkeletonBasedPhysarumSystem\20211201_CSystem\Mask_B_Rect1.png")
path_2 = FilePath("D:\XYF\PROJECT_PERSONAL\SkeletonBasedPhysarumSystem\Paper\Mask_B_a_1.png")
move_3 = Move(Motion=pt_4)  # -> Geometry, Transform; disabled
center_8 = Center(Geometric=rectangle.Rectangle)  # -> Center, Dimension
scale_3 = Scale(Center=data_3, Factor=number_slider_16)  # -> Geometry, Transform; disabled
scale_nu_2 = ScaleNU(Geometry=center_6.Center, Plane=data_3, ScaleX=number_slider_13, ScaleY=number_slider_14, ScaleZ=number_slider_15)  # -> Geometry, Transform; disabled
move_4 = Move(Geometry=line_2, Motion=Vector(0, 0, 10))  # -> Geometry, Transform; disabled
c_script = CSharpScript(
    file=path_2,
    baseMesh=mplane.Mesh,
    bound=rectangle.Rectangle,
    strokeSize=number_slider_11,
    threshold=Slider(0.5, range=0..1),
    edgeSegmentLength=Slider(2, range=0..100),
    transform=comp,
    reset=Button())  # -> out, A; inputs file: String, baseMesh: Mesh, bound: Rectangle3d, strokeSize: Double, threshold: Double, edgeSegmentLength: Double, transform: Transform, constantFeed: list of Line, environmentImage: String, reset: Boolean
# ---------- c_script: C# usings ----------
using System.Drawing;
using Grasshopper.Kernel.Geometry;
# ---------- c_script: C# ----------
    if (counter == 0){
      sourceImg = new Bitmap(file);
      rw = sourceImg.Width;
      rh = sourceImg.Height;

      iterImg = sourceImg.Clone(new Rectangle(0, 0, rw, rh), System.Drawing.Imaging.PixelFormat.Format32bppPArgb);
      canvas = Graphics.FromImage(iterImg);
      lines = new List<Line>();
      process = new Grasshopper.DataTree<Line>();
    }
    counter++;

    if(reset){
      counter = 0;
    }

    //Drawing setup - pen and shape
    pen = new Pen(Color.White, Convert.ToSingle(rw * strokeSize / bound.Width));
    pen.StartCap = System.Drawing.Drawing2D.LineCap.Triangle;
    pen.EndCap = System.Drawing.Drawing2D.LineCap.Triangle;

    //Skeletonize and draw on iterImg with skeleton trails
    lines.Clear();
    try{
      Extract(threshold, iterImg, baseMesh, bound, edgeSegmentLength, strokeSize, ref lines);
      canvas.Clear(Color.Black);

      foreach(Line lraw in lines){
        Line l = new Line(lraw.PointAt(0.5), lraw.PointAt(0.5) + new Point3d(0, 0.5, 0));
        l.Transform(transform);
        canvas.DrawLine(pen, Convert.ToInt32(rw * (l.From.X - bound.X.Min) / bound.Width), Convert.ToInt32(rh * (l.From.Y - bound.Y.Min) / bound.Height), Convert.ToInt32(rw * (l.To.X - bound.X.Min) / bound.Width), Convert.ToInt32(rh * (l.To.Y - bound.Y.Min) / bound.Height));
      }
    }
    catch(Exception exMsg){
      Print(exMsg.Message);
      counter = 0;
    }

    foreach(Line l in constantFeed){
      canvas.DrawLine(pen, Convert.ToInt32(rw * (l.From.X - bound.X.Min) / bound.Width), Convert.ToInt32(rh * (l.From.Y - bound.Y.Min) / bound.Height), Convert.ToInt32(rw * (l.To.X - bound.X.Min) / bound.Width), Convert.ToInt32(rh * (l.To.Y - bound.Y.Min) / bound.Height));
    }

    //Overlay environment image
    try{
      canvas.DrawImage(environmentImg, new Rectangle(0, 0, rw, rh));
      environmentImg = new Bitmap(environmentImage);
    }
    catch(Exception exMsg){
      Print(exMsg.Message);
    }

    Print(counter.ToString());
    A = lines;
    iterImg.Save(@"D:\XYF\PROJECT_PERSONAL\SkeletonBasedPhysarumSystem\Paper\FRBrushShape\image" + counter + ".jpg");
# ---------- c_script: C# additional code ----------
  Rhino.Geometry.Plane cutter = new Rhino.Geometry.Plane(new Point3d(0, 0, 0.5), new Vector3d(0, 0, 1));
  Bitmap sourceImg;
  Bitmap iterImg;
  Bitmap environmentImg;
  Graphics canvas;
  int rw;
  int rh;
  List<Line> lines;
  Grasshopper.DataTree<Line> process;
  Pen pen;


  int counter = 0;
  public void Extract(double threshold0, Bitmap sourceImg0, Mesh baseMesh0, Rectangle3d r0, double edgeSegmentLength0, double maxSkeletonLength0, ref List<Line> result){
    double threshold = threshold0;
    Bitmap sourceImg = sourceImg0;
    Mesh baseMesh = baseMesh0;
    Rectangle3d r = r0;
    double edgeSegmentLength = edgeSegmentLength0;
    double maxSkeletonLength = maxSkeletonLength0;

    List<Point3d> extractedPoints = new List<Point3d>();
    Point3d[] rectCorners = r.BoundingBox.GetCorners();

    Polyline[] edges;
    for(int i = 0; i < baseMesh.Vertices.Count; i++){
      var pt = baseMesh.Vertices[i];
      Color rawColor = sourceImg.GetPixel(Math.Min(Convert.ToInt32((pt.X / r.Width) * sourceImg.Width), sourceImg.Width - 1), Math.Min(Convert.ToInt32((pt.Y / r.Height) * sourceImg.Height), sourceImg.Height - 1));
      baseMesh.Vertices.SetVertex(i, pt.X, pt.Y, rawColor.GetBrightness());
    }
    edges = Rhino.Geometry.Intersect.Intersection.MeshPlane(baseMesh, cutter);


    List<Node2> unit = new List<Node2>();
    Node2List nodes = new Node2List();

    for(int i = 0; i < edges.Length; i++){
      var edgesCrv = edges[i].ToPolylineCurve();
      for(int j = 0; j < (edgesCrv.Domain.Max - edgesCrv.Domain.Min) / (edgeSegmentLength * 1); j++){
        var tpt = edgesCrv.PointAt(j * edgeSegmentLength * 1);
        unit.Add(new Node2(tpt.X, tpt.Y));
      }
    }

    foreach(Node2 a in unit){
      nodes.Append(a);
    }

    Node2List outline = new Node2List();
    foreach (Point3d p in rectCorners)
    {
      Node2 n = new Node2(p.X, p.Y);
      outline.Append(n);
    }

    var delaunay = Grasshopper.Kernel.Geometry.Delaunay.Solver.Solve_Connectivity(nodes, 0.1, false);
    var voronoi = Grasshopper.Kernel.Geometry.Voronoi.Solver.Solve_Connectivity(nodes, delaunay, outline);


    List<Line> centralLine = new  List<Line>();
    List<Double> vs = new  List<Double>();
    List<Double> ve = new  List<Double>();
    List<Point3d> ps = new  List<Point3d>();
    List<Point3d> pe = new  List<Point3d>();
    foreach( var c in voronoi)
    {
      Polyline pl = c.ToPolyline();
      var seg = pl.GetSegments();

      foreach( Line l in seg){
        var pStart = sourceImg.GetPixel(Convert.ToInt32((l.From.X / r.Width) * (sourceImg.Width - 1)), Convert.ToInt32((l.From.Y / r.Height) * (sourceImg.Height - 1)));
        var pEnd = sourceImg.GetPixel(Convert.ToInt32((l.To.X / r.Width) * (sourceImg.Width - 1)), Convert.ToInt32((l.To.Y / r.Height) * (sourceImg.Height - 1)));
        var pMid = sourceImg.GetPixel(Convert.ToInt32((0.5 * (l.From.X + l.To.X) / r.Width) * (sourceImg.Width - 1)), Convert.ToInt32((0.5 * (l.From.Y + l.To.Y) / r.Height) * (sourceImg.Height - 1)));

        if(pStart.GetBrightness() >= threshold && pMid.GetBrightness() >= threshold && pEnd.GetBrightness() >= threshold && l.Length < maxSkeletonLength){
          centralLine.Add(l);
        }
      }
    }
    result = centralLine;
  }
# ---------- end c_script ----------
rotate_4 = Rotate(Angle=number_slider_10, Plane=data_3)  # -> Geometry, Transform; disabled
scale_4 = Scale(Geometry=rectangle.Rectangle, Center=center_8.Center, Factor=Slider(0.999, range=0..1))  # -> Geometry, Transform
panel = Panel(c_script.out)
number_slider_17 = Slider(0.966, range=0..1)  # disabled
explode_4 = Explode(Curve=rectangle_2.Rectangle, Recursive=True)  # -> Segments, Vertices; disabled
xy = XYPlane(Origin=Point(0, 0, 0))
comp_2 = Compound(Transforms=flatten([scale_nu_2.Transform, rotate_4.Transform, move_3.Transform]))  # disabled
center_9 = Center(Geometric=rectangle_2.Rectangle)  # -> Center, Dimension; disabled
path_3 = FilePath("D:\XYF\PROJECT_PERSONAL\SkeletonBasedPhysarumSystem\Paper\GrayScaleRaw2.jpg")  # disabled
data_5 = Data(c_script.A)
trim = TrimWithRegion(Curve=data_5, Region=scale_4.Geometry, Plane=xy)  # -> Inside, Outside
preview = CustomPreview(Geometry=scale_4.Geometry, Material=ColourSwatch(SwatchColor=RGB(0, 0, 0)))
bitmapfromfile = BitmapFromFile(FilePath=path_3)  # disabled
number_slider_18 = Slider(2, range=0..100)  # disabled
number_slider_19 = Slider(4, range=0..100)  # disabled
number_slider_20 = Slider(3, range=0..100)  # disabled
number_slider_21 = Slider(0.5, range=0..1)  # disabled
number_slider_22 = Slider(10.128, range=0..100)  # disabled
scale_5 = Scale(Geometry=explode_4.Segments, Center=center_9.Center, Factor=number_slider_17)  # -> Geometry, Transform; disabled
c_script_2 = CSharpScript()  # -> out, C; inputs pt: list, rect: Rectangle3d; disabled
# ---------- c_script_2: C# usings ----------
using System.Drawing;
# ---------- c_script_2: C# ----------
    Bitmap image = img as Bitmap;
    List<Color> cc = new List<Color>();
    foreach(Point3d p in pt){
      Color c = image.GetPixel(Convert.ToInt32((image.Width - 1) * (p.X - rect.X.Min) / rect.Width), Convert.ToInt32((image.Height - 1) * (1-(p.Y - rect.Y.Min) / rect.Height)));
      cc.Add(c);
    }
    C = cc;
# ---------- end c_script_2 ----------
button = Button()  # disabled
previewlw = CustomPreviewLineweights(Geometry=trim.Inside, Shader=ColourSwatch(SwatchColor=RGB(0, 0, 0)), Thickness=number_slider_11, Absolute=False)
trigger_2 = Trigger(Interval=1, TimerInterval=5, Target=c_script_3)  # disabled
path_4 = FilePath("D:\XYF\PROJECT_PERSONAL\SkeletonBasedPhysarumSystem\20211201_CSystem\Mask_B_Rect1.png")  # disabled
path_5 = FilePath("D:\XYF\PROJECT_PERSONAL\SkeletonBasedPhysarumSystem\Paper\Mask_B_a_1.png")  # disabled
dom = ConstructDomain(DomainStart=number_slider_18, DomainEnd=number_slider_19)  # disabled
number_slider_23 = Slider(0.999, range=0..1)  # disabled
center_10 = Center(Geometric=rectangle_2.Rectangle)  # -> Center, Dimension; disabled
c_script_3 = CSharpScript(
    file=path_5,
    baseMesh=mplane_2.Mesh,
    bound=rectangle_2.Rectangle,
    strokeSize=dom,
    threshold=number_slider_21,
    edgeSegmentLength=number_slider_20,
    transform=comp_2,
    constantFeed=scale_5.Geometry,
    grayScale=bitmapfromfile,
    reset=button)  # -> out, A; inputs file: String, baseMesh: Mesh, bound: Rectangle3d, threshold: Double, edgeSegmentLength: Double, transform: Transform, constantFeed: list of Line, environmentImage: String, reset: Boolean; disabled
# ---------- c_script_3: C# ----------
    Bitmap gray = grayScale as Bitmap;
    if (counter == 0){
      sourceImg = new Bitmap(file);
      rw = sourceImg.Width;
      rh = sourceImg.Height;

      iterImg = sourceImg.Clone(new Rectangle(0, 0, rw, rh), System.Drawing.Imaging.PixelFormat.Format32bppPArgb);
      canvas = Graphics.FromImage(iterImg);
      lines = new List<Line>();
      process = new Grasshopper.DataTree<Line>();
    }
    counter++;

    if(reset){
      counter = 0;
    }


    //Skeletonize and draw on iterImg with skeleton trails
    lines.Clear();
    try{
      Extract(threshold, iterImg, baseMesh, bound, edgeSegmentLength, strokeSize.Min, ref lines);
      canvas.Clear(Color.Black);

      foreach(Line l in lines){

        Point3d p = l.PointAt(0.5);
        Color gc = gray.GetPixel(Convert.ToInt32((gray.Width - 1) * (p.X - bound.X.Min) / bound.Width), Convert.ToInt32((gray.Height - 1) * (1 - (p.Y - bound.Y.Min) / bound.Height)));
        //Drawing setup - pen width

        pen = new Pen(Color.White, Convert.ToSingle(gc.GetBrightness() * (rw * strokeSize.Max / bound.Width) + rw * strokeSize.Min / bound.Width));
        pen.StartCap = System.Drawing.Drawing2D.LineCap.Round;
        pen.EndCap = System.Drawing.Drawing2D.LineCap.Round;

        l.Transform(transform);
        canvas.DrawLine(pen, Convert.ToInt32(rw * (l.From.X - bound.X.Min) / bound.Width), Convert.ToInt32(rh * (l.From.Y - bound.Y.Min) / bound.Height), Convert.ToInt32(rw * (l.To.X - bound.X.Min) / bound.Width), Convert.ToInt32(rh * (l.To.Y - bound.Y.Min) / bound.Height));
      }
    }
    catch(Exception exMsg){
      Print(exMsg.Message);
      counter = 0;
    }

    foreach(Line l in constantFeed){
      canvas.DrawLine(pen, Convert.ToInt32(rw * (l.From.X - bound.X.Min) / bound.Width), Convert.ToInt32(rh * (l.From.Y - bound.Y.Min) / bound.Height), Convert.ToInt32(rw * (l.To.X - bound.X.Min) / bound.Width), Convert.ToInt32(rh * (l.To.Y - bound.Y.Min) / bound.Height));
    }

    //Overlay environment image
    try{
      canvas.DrawImage(environmentImg, new Rectangle(0, 0, rw, rh));
      environmentImg = new Bitmap(environmentImage);
    }
    catch(Exception exMsg){
      Print(exMsg.Message);
    }

    Print(counter.ToString());
    A = lines;
    iterImg.Save(@"D:\XYF\PROJECT_PERSONAL\SkeletonBasedPhysarumSystem\Paper\FRVariedBrushSize\iterImg"+counter+".jpg");
# ---------- c_script_3: C# additional code ----------
  Rhino.Geometry.Plane cutter = new Rhino.Geometry.Plane(new Point3d(0, 0, 0.5), new Vector3d(0, 0, 1));
  Bitmap sourceImg;
  Bitmap iterImg;
  Bitmap environmentImg;
  Graphics canvas;
  int rw;
  int rh;
  List<Line> lines;
  Grasshopper.DataTree<Line> process;
  Pen pen;


  int counter = 0;
  public void Extract(double threshold0, Bitmap sourceImg0, Mesh baseMesh0, Rectangle3d r0, double edgeSegmentLength0, double maxSkeletonLength0, ref List<Line> result){
    double threshold = threshold0;
    Bitmap sourceImg = sourceImg0;
    Mesh baseMesh = baseMesh0;
    Rectangle3d r = r0;
    double edgeSegmentLength = edgeSegmentLength0;
    double maxSkeletonLength = maxSkeletonLength0;

    List<Point3d> extractedPoints = new List<Point3d>();
    Point3d[] rectCorners = r.BoundingBox.GetCorners();

    Polyline[] edges;
    for(int i = 0; i < baseMesh.Vertices.Count; i++){
      var pt = baseMesh.Vertices[i];
      Color rawColor = sourceImg.GetPixel(Math.Min(Convert.ToInt32((pt.X / r.Width) * sourceImg.Width), sourceImg.Width - 1), Math.Min(Convert.ToInt32((pt.Y / r.Height) * sourceImg.Height), sourceImg.Height - 1));
      baseMesh.Vertices.SetVertex(i, pt.X, pt.Y, rawColor.GetBrightness());
    }
    edges = Rhino.Geometry.Intersect.Intersection.MeshPlane(baseMesh, cutter);


    List<Node2> unit = new List<Node2>();
    Node2List nodes = new Node2List();

    for(int i = 0; i < edges.Length; i++){
      var edgesCrv = edges[i].ToPolylineCurve();
      for(int j = 0; j < (edgesCrv.Domain.Max - edgesCrv.Domain.Min) / edgeSegmentLength; j++){
        var tpt = edgesCrv.PointAt(j * edgeSegmentLength);
        unit.Add(new Node2(tpt.X, tpt.Y));
      }
    }

    foreach(Node2 a in unit){
      nodes.Append(a);
    }

    Node2List outline = new Node2List();
    foreach (Point3d p in rectCorners)
    {
      Node2 n = new Node2(p.X, p.Y);
      outline.Append(n);
    }

    var delaunay = Grasshopper.Kernel.Geometry.Delaunay.Solver.Solve_Connectivity(nodes, 0.1, false);
    var voronoi = Grasshopper.Kernel.Geometry.Voronoi.Solver.Solve_Connectivity(nodes, delaunay, outline);


    List<Line> centralLine = new  List<Line>();
    List<Double> vs = new  List<Double>();
    List<Double> ve = new  List<Double>();
    List<Point3d> ps = new  List<Point3d>();
    List<Point3d> pe = new  List<Point3d>();
    foreach( var c in voronoi)
    {
      Polyline pl = c.ToPolyline();
      var seg = pl.GetSegments();

      foreach( Line l in seg){
        var pStart = sourceImg.GetPixel(Convert.ToInt32((l.From.X / r.Width) * (sourceImg.Width - 1)), Convert.ToInt32((l.From.Y / r.Height) * (sourceImg.Height - 1)));
        var pEnd = sourceImg.GetPixel(Convert.ToInt32((l.To.X / r.Width) * (sourceImg.Width - 1)), Convert.ToInt32((l.To.Y / r.Height) * (sourceImg.Height - 1)));
        var pMid = sourceImg.GetPixel(Convert.ToInt32((0.5 * (l.From.X + l.To.X) / r.Width) * (sourceImg.Width - 1)), Convert.ToInt32((0.5 * (l.From.Y + l.To.Y) / r.Height) * (sourceImg.Height - 1)));

        if(pStart.GetBrightness() >= threshold && pMid.GetBrightness() >= threshold && pEnd.GetBrightness() >= threshold && l.Length < maxSkeletonLength){
          centralLine.Add(l);
        }
      }
    }
    result = centralLine;
  }
# ---------- end c_script_3 ----------
scale_6 = Scale(Geometry=rectangle_2.Rectangle, Center=center_10.Center, Factor=number_slider_23)  # -> Geometry, Transform; disabled
panel_2 = Panel(c_script_3.out)  # disabled
swatch = ColourSwatch(SwatchColor=RGB(0, 0, 0))  # disabled
xy_2 = XYPlane(Origin=Point(0, 0, 0))  # disabled
swatch_2 = ColourSwatch(SwatchColor=RGB(0, 0, 0))  # disabled
data_6 = Data(c_script_3.A)  # disabled
trim_2 = TrimWithRegion(Curve=data_6, Region=scale_6.Geometry, Plane=xy_2)  # -> Inside, Outside; disabled
preview_2 = CustomPreview(Geometry=scale_6.Geometry, Material=swatch)  # disabled
previewlw_2 = CustomPreviewLineweights(Geometry=trim_2.Inside, Shader=swatch_2, Thickness=number_slider_22, Absolute=False)  # disabled
