# Grasshopper definition SkeletonizationTest.gh (Grasshopper 1.0.7)
# plug-ins: Coral, Human, Heteroptera

number_slider = Slider(720, range=0..1000)
number_slider_2 = Slider(250, range=0..1000)
path = FilePath("D:\XYF\Z7Z88\2a47d42f-3583-4abe-a0b9-da5295bb5425.jpg")
neg = Negative(Value=Slider(800, range=0..1000))
rectangle = Rectangle(Plane=PlaneXY(0, 0, 0), XSize=number_slider, YSize=number_slider, Radius=0)  # -> Rectangle, Length
X = UnitX(Factor=neg)
mplane = MeshPlane(Boundary=rectangle.Rectangle, WidthCount=number_slider_2, HeightCount=number_slider_2)  # -> Mesh, Area
move = Move(Geometry=mplane.Mesh, Motion=X)  # -> Geometry, Transform
center = Center(Geometric=rectangle.Rectangle)  # -> Center, Dimension
xz = XZPlane(Origin=center.Center)
skeletonization2d = Skeletonization2D(
    ImageFile=path,
    Mesh=mplane.Mesh,
    Boundary=rectangle.Rectangle,
    Threshold=0.5,
    EdgeDivisionLength=Slider(1, range=0..10),
    MaximumSkeletonLength=Slider(5.667, range=0..10))
mirror = Mirror(Geometry=skeletonization2d, Plane=xz)  # -> Geometry, Transform
previewmat = CustomPreviewMaterials(Geometry=move.Geometry, DiffuseColor=RGB(255, 255, 255), DiffuseBitmap=path)
previewlw = CustomPreviewLineweights(
    Geometry=mirror.Geometry,
    Shader=ColourSwatch(SwatchColor=RGB(0, 0, 0)),
    Thickness=Slider(2, range=0..10),
    Absolute=False)
